# Grasshopper definition 200813_GH_Cockatoo_PipelineUtilities_Example.gh (Grasshopper 1.0.7)
# plug-ins: Kangaroo2 Components

# ----
# Define parent layer name for the
# set and individual sublayer names
additional_non_referenced_layers = Panel("noref__SketchGeometry")
layer_names_of_different_assembly_elemen = Panel("""MeshOutlines
CoCircularCurves
AnchorPoints
AnchorCurves""")  # "Layer names of different Assembly Elements"
prefix_for_parent_layers_of_pipeline = Panel("IGPIPELINE__")

# ----
# Create or load a timestamped layer set.
# Loading is done by checking the active
# rhino layer!
create_layers_and_reference = Button()
load_layers_and_reference = Button()

# ----
# Turn on to dynamically update
# when rhino geometry is drawn
dynamicupdate = BooleanToggle(True)

cocircularcolor = ColourSwatch(SwatchColor=RGB(250, 0, 0))

# ----
# Colors for the pipeline layers
anchorcrvscolor = ColourSwatch(SwatchColor=RGB(255, 165, 0))
anchorptscolor = ColourSwatch(SwatchColor=RGB(46, 139, 87))
beamcrvscolor = ColourSwatch(SwatchColor=RGB(128, 0, 128))
sketchcolor = ColourSwatch(SwatchColor=RGB(169, 169, 169))
merge = Merge(Data1=beamcrvscolor, Data2=cocircularcolor, Data3=anchorptscolor, Data4=anchorcrvscolor, Data5=sketchcolor)

# ----
# PipelineController
# 
# for managing interactive
# geometry pipelines
# AssemblyGeo will contain everything
# that is drawn on the referenced layer set
# each branch represents a layer
pc = PipelineController(
    DynamicUpdate=dynamicupdate,
    CreateAndRef=create_layers_and_reference,
    LoadAndRef=load_layers_and_reference,
    ParentLayerPrefix=prefix_for_parent_layers_of_pipeline,
    ReferenceLayers=layer_names_of_different_assembly_elemen,
    AssistanceLayers=additional_non_referenced_layers,
    LayerColours=merge)  # -> AssemblyGeo, CurrentLayers; inputs DynamicUpdate: Boolean, ReferenceLayers: list, AssistanceLayers: list, LayerColours: list of Color
# ---------- pc: Python ----------
"""
Provides an interface to work with interactive geometry pipelines.
    Inputs:
        DynamicUpdate: If True, the component will listen to changes in the Rhino document and update automatically. {item, boolean}
        CreateAndRef: Set to true to create new timestamped pipeline-layers and reference them. {item, boolean}
        LoadAndRef: Set to true to load existing pipeline-layers based on the currently active Rhino layer. {item, boolean}
        ParentLayerPrefix: The prefix for parent pipeline-layers {item, string}
        ReferenceLayers: Specify the referenced layer names here (i.e. connect a panel). {list, string}
        AssistanceLayers: Specify additional non-referenced assistance layers here (i.e. connect a panel). {list, string}
        LayerColours: Use this to specify a color for the layers that are created by the component. {list, string}
    Outputs:
        AssemblyGeo: The geometry in a datatree branched based on the specified layers. {tree, geometry}
        CurrentLayers: The currently referenced layers as strings. {list, string}
    Remarks:
        Author: Max Eschenbach
        License: MIT License
        Version: 200705
"""

# PYTHON STANDARD LIBRARY IMPORTS
from __future__ import division
import time

# GHPYTHON SDK IMPORTS
from ghpythonlib.componentbase import executingcomponent as component
import Grasshopper, GhPython
import System
import Rhino
import rhinoscriptsyntax as rs

# CUSTOM RHINO IMPORTS
import rhinoscriptsyntax as rs
import scriptcontext as sc
from scriptcontext import sticky as st

# ADDITIONAL IMPORTS
from System.Drawing import Color

# GHENV COMPONENT SETTINGS
ghenv.Component.Name = "PipelineController"
ghenv.Component.NickName = "PC"
ghenv.Component.Category = "Cockatoo"
ghenv.Component.SubCategory = "01 Pipeline Controlling"

class PipelineController(component):
    
    # UNIQUE STICKY KEY OR STORING LAYERNAMES
    LNKEY = str(ghenv.Component.InstanceGuid) + "___LAYERNAMES"
    EVKEY = str(ghenv.Component.InstanceGuid) + "___EVENTS"
    FLAG = str(ghenv.Component.InstanceGuid) + "___FLAG"
    
    # COMPONENT UPDATING -------------------------------------------------------
    
    def updateComponent(self):
        # define callback action
        def callBack(e):
            self.ExpireSolution(False)
        # get ghDoc
        ghDoc = self.OnPingDocument()
        # schedule new solution
        ghDoc.ScheduleSolution(1, Grasshopper.Kernel.GH_Document.GH_ScheduleDelegate(callBack))
    
    # EVENT HANDLING -----------------------------------------------------------
    
    def subscribe_to(self, event, func, key):
        if not self.EVKEY in st:
            st[self.EVKEY] = {}
        if key not in st[self.EVKEY]:
            st[self.EVKEY][key] = event
        ukey = str(self.InstanceGuid) + "_" + key
        if ukey not in st:
            st[ukey] = func
            event += st[ukey]
    
    def unsubscribe_all(self):
        if self.EVKEY in st:
            for key in st[self.EVKEY]:
                ukey = str(self.InstanceGuid) + "_" + key
                if ukey in st:
                    st[self.EVKEY][key] -= st[ukey]
                    st.Remove(ukey)
        st[self.EVKEY] = {}
    
    def flagEvent(self, sender, e):
        st[self.FLAG] = True
    
    def updateEvent(self, sender, e):
        if st[self.FLAG] == True:
            st[self.FLAG] = False
            self.updateComponent()
    
    def unsubEvent(self, sender, e):
        self.unsubscribe_all()
    
    # LAYER SET HANDLING -------------------------------------------------------
    
    def CreateReferenceLayers(self, parentPrefix, refLayers, norefLayers, colours):
        # get timestamp
        ts = time.strftime("%y%m%d_%H-%M")
        
        # create parent layer name
        parentLayername = parentPrefix + ts
        self.Message = "Referenced: " + str(parentLayername)
        
        # check if parent layer exists
        sc.doc = Rhino.RhinoDoc.ActiveDoc
        exists = rs.IsLayer(parentLayername)
        
        if exists:
            self.AddRuntimeMessage(self.RuntimeMessageLevel.Remark,
                "Parent Layer already exists! Returning valid existing layers.")
            # get all children layers
            allchildren = rs.LayerChildren(parentLayername)
            # check all children layers for validity
            validchildren = [parentLayername + "::" + vc for vc in refLayers]
            realchildren = []
            for c in allchildren:
                if c in validchildren:
                    realchildren.append(c)
            # set sticky to real found child layers
            st[self.LNKEY] = realchildren
            
            # switch back to ghdoc
            sc.doc = ghdoc
            
            # return layer names
            return realchildren
        else:
            # switch to Rhino doc
            sc.doc = Rhino.RhinoDoc.ActiveDoc
            # create parent layer
            parentLayer = rs.AddLayer(parentLayername, Color.Black)
            
            # create referenced layers
            newLayers = []
            for i, rl in enumerate(refLayers + norefLayers):
                lay = rs.AddLayer(rl, 
                                  colours[i], 
                                  parent = parentLayername)
                if rl in refLayers:
                    newLayers.append(lay)
            
            # add them to the sticky
            st[self.LNKEY] = newLayers
            
            # switch back to ghdoc
            scdoc = ghdoc
            
            # return layer names/paths
            return newLayers
    
    def LoadCurrentLayers(self, refLayers):
        # switch to RhinoDoc
        sc.doc = Rhino.RhinoDoc.ActiveDoc
        
        # retrieve current layer
        cl = rs.CurrentLayer()
        
        # check childcount
        childcount = rs.LayerChildCount(cl)
        
        # if no children, layer has to be childlayer or unrelated
        if childcount == 0:
            # get parent layer
            parent = rs.ParentLayer(cl)
            # switch back to GhDoc
            sc.doc = ghdoc
            if parent:
                allvalid = [parent + "::" + l for l in refLayers]
                # set message and return all valid children
                self.Message = "Referenced: " + str(parent)
                st[self.LNKEY] = allvalid
                return allvalid
            else:
                st[self.LNKEY] = None
                self.Message = None
                return None
        
        # if no children, layer has to be parent layer
        elif childcount > 0:
            parent = cl
            # switch back to GhDoc and return all valid layers
            scdoc = ghdoc
            if parent:
                allvalid = [parent + "::" + l for l in refLayers]
                # set message and return all valid children
                self.Message = "Referenced: " + str(parent)
                st[self.LNKEY] = allvalid
                return allvalid
        
        else:
            # switch back to GhDoc
            scdoc = ghdoc
            st[self.LNKEY] = None
            return None
    
    def retrieveGeometry(self, layers):
        geometry = []
        
        sc.doc = Rhino.RhinoDoc.ActiveDoc
        
        for i, layer in enumerate(layers):
            objs = [rs.coercegeometry(obj) for obj in rs.ObjectsByLayer(layer)]
            
            if objs == None:
                objs = []
            
            for i, obj in enumerate(objs):
                if type(obj) == Rhino.Geometry.Point:
                    objs[i] = Rhino.Geometry.Point3d(obj.Location)
            
            geometry.append(objs)
        
        sc.doc = ghdoc
        return geometry
    
    def RunScript(self, DynamicUpdate, CreateAndRef, LoadAndRef, ParentLayerPrefix, ReferenceLayers, AssistanceLayers, LayerColours):
        # check for unique key in sticky dictionary
        if not self.LNKEY in st:
            st[self.LNKEY] = None
        
        # define output variables ----------------------------------------------
        AssemblyGeo = Grasshopper.DataTree[object]()
        CurrentLayers = []
        
        # subscribe to events for automatic component updating -----------------
        if DynamicUpdate:
            self.subscribe_to(Rhino.RhinoDoc.BeforeTransformObjects, self.flagEvent, "BeforeTransformObjects")
            self.subscribe_to(Rhino.RhinoDoc.DeleteRhinoObject, self.flagEvent, "DeleteRhinoObject")
            self.subscribe_to(Rhino.RhinoDoc.AddRhinoObject, self.flagEvent, "AddRhinoObject")
            #self.subscribe_to(Rhino.RhinoDoc.LayerTableEvent, self.flagEvent, "LayerTableEvent")
            self.subscribe_to(Rhino.RhinoDoc.UndeleteRhinoObject, self.flagEvent, "UndeleteRhinoObjects")
            self.subscribe_to(Rhino.RhinoApp.Idle, self.updateEvent, "Idle")
            self.subscribe_to(Rhino.RhinoDoc.CloseDocument, self.unsubEvent, "CloseDocument")
            self.subscribe_to(Rhino.RhinoDoc.NewDocument, self.unsubEvent, "NewDocument")
        else:
            self.unsubscribe_all()
        
        # catch missing layer colours ------------------------------------------
        laycount = len(ReferenceLayers + AssistanceLayers)
        if not LayerColours or len(LayerColours) == 0:
            LayerColours = [Color.Black] * laycount
        elif len(LayerColours) < len(ReferenceLayers + AssistanceLayers):
            addCols = [Color.Black] * (laycount - len(LayerColours))
            LayerColours.extend(addCols)
        
        # if create button is pressed, create new layers and reference them ----
        if CreateAndRef == True:
            CurrentLayers = self.CreateReferenceLayers(ParentLayerPrefix,
                                                       ReferenceLayers,
                                                       AssistanceLayers,
                                                       LayerColours)
        # if load button is pressed, load from the current rhino-layer ---------
        elif LoadAndRef == True:
            # retrieve the current layerset based on the active rhino layer
            CurrentLayers = self.LoadCurrentLayers(ReferenceLayers)
        # if no button is pressed, make some checks and run standard procedure -
        elif self.LNKEY in st and st[self.LNKEY] != None:
            layer_names = st[self.LNKEY]
            CurrentLayers = layer_names
        # fall back and return if there are no layer names stored in sticky
        elif st[self.LNKEY] == None:
            try:
                # retrieve the current layerset based on the active rhino layer
                CurrentLayers = self.LoadCurrentLayers(ReferenceLayers)
            except:
                return AssemblyGeo, PipelineGeometry, CurrentLayers
        
        # retrieve all geometry
        if CurrentLayers:
            try:
                allgeometry = self.retrieveGeometry(CurrentLayers)
            except ValueError, errMsg:
                self.AddRuntimeMessage(self.RuntimeMessageLevel.Error,
                                       str(errMsg))
                allgeometry = None
        else:
            self.AddRuntimeMessage(self.RuntimeMessageLevel.Warning,
                "Could not load layerset. Check your current Rhino layer or " +
                "the controllers input parameters")
            allgeometry = None
        
        if allgeometry:
            for i, geo in enumerate(allgeometry):
                AssemblyGeo.AddRange(geo, Grasshopper.Kernel.Data.GH_Path(i))
        
        # return outputs
        return AssemblyGeo, CurrentLayers
# ---------- end pc ----------
currently_referenced_layers = Panel(pc.CurrentLayers)
assemblygeo = Geometry(pc.AssemblyGeo)

# ----
# ValueWatchDog
# 
# watches some input values and
# sends a 'True' if anything changes.
# Useful for automatically resetting the K2 solver.
createandreferencelayers = Data(create_layers_and_reference)
loadandreferencelayers = Data(load_layers_and_reference)
enable_valuewatchdog = BooleanToggle(False)
merge_2 = Merge(Data1=createandreferencelayers, Data2=loadandreferencelayers)  # -> flatten(Result)
vwd = ValueWatchdog(WatchedValues=merge_2, Enable=enable_valuewatchdog)  # -> Reset; inputs WatchedValues: list
# ---------- vwd: Python ----------
"""
Listens for changes in a list of values and sends a True value if anything changes
(this can be used to reset the Kangaroo Solver for example).
    Inputs:
        WatchedValues: These are the values that are being watched. Has to be a flat list ideally (but might work with datatrees, too). {list, data}
        Enable: If True, the ValueWatchdog is active. If false, it isn't. Connect a Toggle to switch it on and off. {item,boolean}
    Outputs:
        solverReset: Triggers a True when anything has changed, otherwise false. {list,polyline/curve}
    Remarks:
        Author: Max Eschenbach
        License: MIT License
        Version: 200705
"""

# GHPYTHON SDK IMPORTS
from ghpythonlib.componentbase import executingcomponent as component
import Grasshopper, GhPython
import System
import Rhino
import rhinoscriptsyntax as rs

# CUSTOM RHINO IMPORTS
from scriptcontext import sticky as st

ghenv.Component.Name = "ValueWatchdog"
ghenv.Component.NickName = "VWD"
ghenv.Component.Category = "Cockatoo"
ghenv.Component.SubCategory = "01 Pipeline Controlling"

class ValueWatchDog(component):
    
    def updateComponent(self):
        # define callback action
        def callBack(e):
            self.ExpireSolution(False)
        # get ghDoc
        ghDoc = self.OnPingDocument()
        # schedule new solution
        ghDoc.ScheduleSolution(1, 
                   Grasshopper.Kernel.GH_Document.GH_ScheduleDelegate(callBack))
    
    def RunScript(self, WatchedValues, Enable):
        ig = self.InstanceGuid
        vKey = str(ig) + "___WATCHEDVALUES"
        
        if Enable:
            if vKey not in st:
                st[vKey] = WatchedValues
                Reset = False
            if st[vKey] != WatchedValues:
                print "reset!"
                Reset = True
                st[vKey] = WatchedValues
                self.Message = str(Reset)
                self.updateComponent()
            else:
                Reset = False
                self.Message = str(Reset)
            
        else:
            self.Message = "ValueWatchdog disabled!"
            Reset = False
        
        # return outputs if you have them; here I try it for you:
        return Reset
# ---------- end vwd ----------

# ----
# GeometryWatchDog
# 
# watches some input geometry and
# sends a 'True' if anything changes.
# Useful for resetting the K2 solver.
enable_pipelinewatchdog = BooleanToggle(True)
assemblygeo_2 = Geometry(flatten(assemblygeo))
gwd = GeometryWatchDog(Geometry=assemblygeo_2, Enable=enable_pipelinewatchdog)  # -> Reset; inputs Geometry: list, Enable: Boolean
# ---------- gwd: Python ----------
"""
Listens for changes in geometry and sends a True value if anything changes
(this can be used to reset the Kangaroo Solver for example).
    Inputs:
        Geometry: This is the geometry that is being watched for changes. {list, geometry}
        Enable: If True, the PipelineWatchdog is active. If false, it isn't. Connect a Toggle to switch it on and off. {item, boolean}
    Outputs:
        solverReset: Triggers a True when anything has changed, otherwise false. {item, boolean}
    Remarks:
        Author: Max Eschenbach
        License: MIT License
        Version: 200705
"""

# GHPYTHON SDK IMPORTS
from ghpythonlib.componentbase import executingcomponent as component
import Grasshopper, GhPython
import System
import Rhino
import rhinoscriptsyntax as rs

# CUSTOM RHINO IMPORTS
from scriptcontext import sticky as st

ghenv.Component.Name = "GeometryWatchDog"
ghenv.Component.NickName = "GWD"
ghenv.Component.Category = "Cockatoo"
ghenv.Component.SubCategory = "01 Pipeline Controlling"

class GeometryWatchDog(component):
    
    def updateComponent(self):
        # define callback action
        def callBack(e):
            self.ExpireSolution(False)
        # get ghDoc
        ghDoc = self.OnPingDocument()
        # schedule new solution
        ghDoc.ScheduleSolution(1, 
                   Grasshopper.Kernel.GH_Document.GH_ScheduleDelegate(callBack))
    
    def RunScript(self, Geometry, Enable):
        
        ig = self.InstanceGuid
        geoKey = str(ig) + "___WATCHEDGEOMETRY"
        resetKey = str(ig) + "___RESETFLAG"
        
        if Enable and Geometry and Geometry != []:
            if geoKey not in st or resetKey not in st or st[resetKey] == True:
                print "Setting geometry"
                st[geoKey] = Geometry
                st[resetKey] = False
                Reset = False
                self.Message = str(Reset)
            elif st[geoKey] != Geometry:
                print "Reset!"
                Reset = True
                st[resetKey] = True
                st[geoKey] = Geometry
                self.Message = str(Reset)
                self.updateComponent()
            else:
                solverReset = False
                Reset = False
                self.Message = str(Reset)
            
        else:
            self.Message = "GeometryWatchdog disabled!"
            Reset = False
        
        # return outputs if you have them; here I try it for you:
        return Reset
# ---------- end gwd ----------

assemblygeo_3 = Geometry(assemblygeo)
bang = ExplodeTree(Data=assemblygeo_3)  # -> Branch0, Branch1, Branch2, Branch3
cocircularcurves = Data(bang.Branch1)
meshoutlines = Data(bang.Branch0)
anchorcurves = Data(bang.Branch3)
anchorpts = Data(bang.Branch2)

or = GateOr(A=gwd, B=vwd)
solverreset = Data(or)

# ----
# build simple quad meshes
meshoutlines_2 = Data(meshoutlines)
explode = Explode(Curve=meshoutlines_2, Recursive=True)  # -> Segments, Vertices
number_slider = Slider(10, range=0..20)
item = ListItem(List=explode.Vertices, Index=0, Wrap=True)  # -> Item, Item1, Item2, Item3, Item4
srf4pt = _4PointSurface(CornerA=item.Item, CornerB=item.Item1, CornerC=item.Item2, CornerD=item.Item3)
mesh_uv = MeshSurface(Surface=srf4pt, UCount=number_slider, VCount=number_slider, Overhang=True, Equalize=False)
basemeshes = Mesh(mesh_uv)

basemeshes_2 = Mesh(basemeshes)
demesh = DeconstructMesh(Mesh=basemeshes_2)  # -> Vertices, Faces, Colours, Normals

# ----
# get coincident particles for anchorpts
# and anchorcrvs input
anchorcurves_2 = Data(anchorcurves)
anchorpts_2 = Data(anchorpts)
pull = PullPoint(Point=flatten(demesh.Vertices), Geometry=[anchorpts_2, anchorcurves_2], ClosestOnly=True)  # -> ClosestPoint, Distance
smaller = SmallerThan(FirstNumber=pull.Distance, SecondNumber=Slider(0.01, range=0.0001..1))  # -> SmallerThan, OrEqualTo
dispatch = Dispatch(List=pull.ClosestPoint, DispatchPattern=smaller.SmallerThan)  # -> ListA, ListB
anchoredparticles = Data(dispatch.ListA)

# ----
# get coincident particles for
# cocircular curves input
cocircularcurves_2 = Data(graft(cocircularcurves))
pull_2 = PullPoint(Point=flatten(demesh.Vertices), Geometry=cocircularcurves_2, ClosestOnly=True)  # -> ClosestPoint, Distance
smaller_2 = SmallerThan(FirstNumber=pull_2.Distance, SecondNumber=Slider(0.01, range=0.0001..1))  # -> SmallerThan, OrEqualTo
dispatch_2 = Dispatch(List=pull_2.ClosestPoint, DispatchPattern=smaller_2.SmallerThan)  # -> ListA, ListB
cocircularparticles = Data(dispatch_2.ListA)

# ----
# Make goals for K2
cocircularparticles_2 = Data(cocircularparticles)
basemeshes_3 = Mesh(basemeshes)
medges = MeshEdges(Mesh=basemeshes_3)  # -> NakedEdges, InteriorEdges, NonManifoldEdges
fcircle = CircleFit(Points=cocircularparticles_2)  # -> Circle, Radius, Deviation
anchoredparticles_2 = Data(anchoredparticles)
multiplication = Multiplication(A=[medges.NakedEdges, medges.InteriorEdges, medges.NonManifoldEdges], B=Slider(0.5, range=0..1))
length_line = LengthLine(
    Line=flatten([medges.NakedEdges, medges.InteriorEdges, medges.NonManifoldEdges]),
    Length=flatten(multiplication),
    Strength=Slider(10, range=0..1000))
oncurve = OnCurve(Points=cocircularparticles_2, Curve=fcircle.Circle, Strength=Slider(50, range=0..100))
cocircular = CoCircular(Points=cocircularparticles_2, Strength=Slider(100, range=0..100))
anchor = Anchor(Point=anchoredparticles_2, Strength=Slider(100000, range=0..100000))
show = Show(G=basemeshes_3)
entwine = Entwine(Branch00=show, Branch01=length_line, Branch02=[oncurve, cocircular], Branch03=anchor, FlattenInputs=True)  # -> simplify(Result)

# ----
# reset by button or by
# geo/value watchdog
button = Button()
solverreset_2 = Data(solverreset)
or_2 = GateOr(A=solverreset_2, B=button)
solver = Solver(GoalObjects=entwine, Reset=or_2, Threshold=1e-15, Tolerance=Slider(0.001, range=0..0.001), On=Toggle(True))  # -> I, V, O
unflatten = UnflattenTree(Tree=solver.O, Guide=entwine)
bang_2 = ExplodeTree(Data=unflatten)  # -> Branch0, Branch1, Branch2, Branch3, Branch4
preview = CustomPreview(Geometry=bang_2.Branch0, Material=ColourSwatch(SwatchColor=RGB(0, 161, 155)))
