# Grasshopper definition 210929_GH_Cockatoo_KnittingPatternGeneration_Example.gh (Grasshopper 1.0.7)
# Copyright: 2019
# plug-ins: Kangaroo2 Components

# ----
# Formfound geometry
formfoundmeshes = Data([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])
preview = CustomPreview(Geometry=formfoundmeshes, Material=ColourSwatch(SwatchColor=RGBA(207, 207, 207, 167)))

# ----
# Custom patch out of the
# formfound geometry
knitmesh_openpatch = Mesh(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)

# ----
# Mesh patch
# 
# Define manual KnitConstraint (variation 3)
# (connect to KCOM as an alternative)
# Split and je-join boundary manually
knitmesh_openpatch_2 = Mesh(knitmesh_openpatch)
medges = MeshEdges(Mesh=knitmesh_openpatch_2)  # -> NakedEdges, InteriorEdges, NonManifoldEdges
rad = Radians(Degrees="35")
join = JoinCurves(Curves=medges.NakedEdges, Preserve=False)
splitatcorners = SplitAtCorners(Poly=join, Angle=rad)  # -> Corners, Parts
item = ListItem(List=splitatcorners.Parts, Index=0, Wrap=True)  # -> Item, Item1, Item2, Item3, Item4
join_2 = JoinCurves(Curves=[item.Item, item.Item4], Preserve=False)
rightboundary = Curve(item.Item1)
leftboundary = Curve(item.Item3)
startcourse = Curve(item.Item2)
endcourse = Curve(join_2)
cmkc = CreateManualKnitConstraint(StartCourse=startcourse, EndCourse=endcourse, LeftBoundary=leftboundary, RightBoundary=rightboundary)  # -> KnitConstraint; inputs StartCourse: Curve, EndCourse: Curve, LeftBoundary: Curve, RightBoundary: Curve
# ---------- cmkc: Python ----------
"""
Used to create a manual KnitConstraint by supplying curves for start, end, left
boundary and right boundary. Together, these curves must form a closed loop!
    Inputs:
        StartCourse: The curve that defines the start of the knit.
                     {item, curve}
        EndCourse: The curve that defines the end of the knit.
                   {item, curve}
        LeftBoundary: The curve that defines the left boundary of the knit.
                      {item, curve}
        RightBoundary: Curve that defines the right boundary of the knit.
                       {item, curve}
    Output:
        KnitConstraint: The KnitConstraint resulting from the given inputs.
                        {item, KnitConstraint}
    Remarks:
        Author: Max Eschenbach
        License: MIT License
        Version: 200731
"""

# PYTHON STANDARD LIBRARY IMPORTS
from __future__ import division

# GHPYTHON SDK IMPORTS
from ghpythonlib.componentbase import executingcomponent as component
import Grasshopper, GhPython
import System
import Rhino
import rhinoscriptsyntax as rs

# GHENV COMPONENT SETTINGS
ghenv.Component.Name = "CreateManualKnitConstraint"
ghenv.Component.NickName ="CMKC"
ghenv.Component.Category = "Cockatoo"
ghenv.Component.SubCategory = "04 Constraints"

# LOCAL MODULE IMPORTS
try:
    from cockatoo import KnitConstraint
except ImportError as e:
    errMsg = "The Cockatoo python module seems to be not correctly " + \
             "installed! Please make sure the module is in you search " + \
             "path, see README for instructions!."
    raise ImportError(errMsg)

class CreateManualKnitConstraint(component):
    
    def __init__(self):
        super(CreateManualKnitConstraint, self).__init__()
        self.SC = None
        self.EC = None
        self.LB = []
        self.RB = []
    
    def get_ClippingBox(self):
        return Rhino.Geometry.BoundingBox()
    
    def DrawViewportWires(self, args):
        try:
            # get display from args
            display = args.Display
            
            if self.SC and self.EC:
                # diplay colors for start and end in custom display
                scol = System.Drawing.Color.Red
                ecol = System.Drawing.Color.Green
                bcol = System.Drawing.Color.SkyBlue
                # add start and end to customdisplay
                display.DrawCurve(self.SC, scol, 3)
                display.DrawCurve(self.EC, ecol, 3)
                [display.DrawCurve(c, bcol, 2) for c in self.LB]
                [display.DrawCurve(c, bcol, 2) for c in self.RB]
            
        except Exception, e:
            System.Windows.Forms.MessageBox.Show(str(e),
                                                 "Error while drawing preview!")
    
    def RunScript(self, StartCourse, EndCourse, LeftBoundary, RightBoundary):
        # define default break angle for mesh boundary
        
        NullTree = Grasshopper.DataTree[object]()
        
        input_complete = True
        if not StartCourse:
            rml = self.RuntimeMessageLevel.Warning
            self.AddRuntimeMessage(rml, "No StartCourse input!")
            input_complete = False
        if not EndCourse:
            rml = self.RuntimeMessageLevel.Warning
            self.AddRuntimeMessage(rml, "No EndCourse input!")
            input_complete = False
        if not LeftBoundary:
            rml = self.RuntimeMessageLevel.Warning
            self.AddRuntimeMessage(rml, "No LeftBoundary input!")
            input_complete = False
        if not RightBoundary:
            rml = self.RuntimeMessageLevel.Warning
            self.AddRuntimeMessage(rml, "No RightBoundary input!")
            input_complete = False
        
        if not input_complete:
            return NullTree
        else:
            # StartBoundary startpoint
            ssp = StartCourse.PointAtStart
            # EndBoundary startpoint
            esp = EndCourse.PointAtStart
            # LeftBoundary startpoint
            lsp = LeftBoundary.PointAtStart
            # RightBoundary startpoint
            rsp = RightBoundary.PointAtStart
            
            # define maximum distance for boundary direction flipping as 10 * abstol
            md = Rhino.RhinoDoc.ActiveDoc.ModelAbsoluteTolerance
            md = md * 10
            
            # check for flipping of left and right boundaries
            lbsccp = StartCourse.ClosestPoint(lsp, md)
            rbsccp = StartCourse.ClosestPoint(rsp, md)
            if not lbsccp[0]:
                LeftBoundary.Reverse()
            if not rbsccp[0]:
                RightBoundary.Reverse()
            
            # check for flipping of start and end courses
            scrbcp = LeftBoundary.ClosestPoint(ssp, md)
            ecrbcp = LeftBoundary.ClosestPoint(esp, md)
            if not scrbcp[0]:
                StartCourse.Reverse()
            if not ecrbcp[0]:
                EndCourse.Reverse()
            
            # set left and right for preview drawing
            self.SC = StartCourse
            self.EC = EndCourse
            self.LB = [LeftBoundary]
            self.RB = [RightBoundary]
            
            KC = KnitConstraint(StartCourse, EndCourse, [LeftBoundary], [RightBoundary])
            
            return KC
# ---------- end cmkc ----------
knitconstraint_openpatch = Data(cmkc)

# ----
# Custom tubular patch out of the
# formfound geometry
# 
# (tubular meshes are still a little
# buggy unfortunately)
knitmesh_tubular = Mesh(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)

# ----
# Mesh patch
# 
# Extract KnitConstraint (variation 1)
# (connect to KCOM as an alternative)
breakangle = Slider(32, range=0..100)
end = Slider(2, range=0..10)
start = Slider(4, range=0..20)
knitmesh_openpatch_3 = Mesh(knitmesh_openpatch)
flipdir = BooleanToggle(True)
rad_2 = Radians(Degrees=breakangle)
ekcfomp = ExtractKnitConstraintsFromOpenMeshPatch(Mesh=knitmesh_openpatch_3, BreakAngle=rad_2, Start=start, End=end, FlipDir=flipdir)  # -> KnitConstraint; inputs Mesh: Mesh, Start: Int32, End: Int32, FlipDir: Boolean
#   port KnitConstraint: The knitconstraints for this mesh for contour generation {tree, polyline}
# ---------- ekcfomp: Python ----------
"""
Extracts the necessary constraint to create KnitContours for an open mesh with
one closed boundary based  on specified parameters. The constraints consist of
a start, end as well as a  left and right boundary. Preview shows the start
course in red, the end course in green and the left/right boundaries in blue.
To extract the constraints, the boundary of the mesh is broken apart at kinks
which exceed the specified break angle. The 'Start' and 'End' parameters define
indices for the resulting list of polylines.
    Inputs:
        Mesh: The mesh that should be knit for constraint extraction.
              {item, mesh}
        BreakAngle: Angle at which to break apart mesh boundary.
                    {item, float}
        StartIndex: Index for the start course.
                    {item, integer}
        EndIndex: Index for the end course.
                  {item, integer}
    Output:
        KnitConstraints: The KnitConstraint for this mesh for contour
                         generation.
                         {item, KnitConstraint}
    Remarks:
        Author: Max Eschenbach
        License: MIT License
        Version: 200801
"""

# PYTHON STANDARD LIBRARY IMPORTS
from __future__ import division

# GHPYTHON SDK IMPORTS
from ghpythonlib.componentbase import executingcomponent as component
import Grasshopper, GhPython
import System
import Rhino
import rhinoscriptsyntax as rs

# GHENV COMPONENT SETTINGS
ghenv.Component.Name = "ExtractKnitConstraintsFromOpenMeshPatch"
ghenv.Component.NickName ="EKCFOMP"
ghenv.Component.Category = "Cockatoo"
ghenv.Component.SubCategory = "04 Constraints"

# LOCAL MODULE IMPORTS
try:
    from cockatoo import KnitConstraint
    from cockatoo.utilities import break_polyline
except ImportError as e:
    errMsg = "The Cockatoo python module seems to be not correctly " + \
             "installed! Please make sure the module is in you search " + \
             "path, see README for instructions!."
    raise ImportError(errMsg)

class ExtractKnitConstraintsFromOpenMeshPatch(component):
    
    def __init__(self):
        super(ExtractKnitConstraintsFromOpenMeshPatch, self).__init__()
        self.SC = None
        self.EC = None
        self.LB = []
        self.RB = []
    
    def get_ClippingBox(self):
        return Rhino.Geometry.BoundingBox()
    
    def DrawViewportWires(self, args):
        try:
            # get display from args
            display = args.Display
            
            if self.SC and self.EC:
                # diplay colors for start and end in custom display
                scol = System.Drawing.Color.Red
                ecol = System.Drawing.Color.Green
                bcol = System.Drawing.Color.SkyBlue
                # add start and end to customdisplay
                display.DrawCurve(self.SC, scol, 3)
                display.DrawCurve(self.EC, ecol, 3)
                [display.DrawCurve(c, bcol, 2) for c in self.LB]
                [display.DrawCurve(c, bcol, 2) for c in self.RB]
            
        except Exception, e:
            System.Windows.Forms.MessageBox.Show(str(e),
                                                 "Error while drawing preview!")
    
    def RunScript(self, Mesh, BreakAngle, Start, End, FlipDir):
        # define default break angle for mesh boundary
        if BreakAngle == None:
            BreakAngle = 1.0
        
        NullTree = Grasshopper.DataTree[object]()
        
        if not Mesh or Start == None or End == None:
            if not Mesh:
                rml = self.RuntimeMessageLevel.Warning
                self.AddRuntimeMessage(rml, "No Mesh input!")
            if not Start:
                rml = self.RuntimeMessageLevel.Warning
                self.AddRuntimeMessage(rml, "No Start input!")
            if not End:
                rml = self.RuntimeMessageLevel.Warning
                self.AddRuntimeMessage(rml, "No End input!")
            return NullTree
        
        # get naked edges of the mesh boundary
        meshBoundary = list(Mesh.GetNakedEdges())
        if len(meshBoundary) > 1:
            raise NotImplementedError("Meshes with multiple closed boundaries"+
                                      " are not supported yet!")
            return Grasshopper.DataTree[object]()
        
        # break the boundary polyline based on angles
        boundarysegments = break_polyline(meshBoundary[0], BreakAngle, as_crv=True)
        
        # sanitize start and end inputs
        if Start > len(boundarysegments)-1:
            Start = len(boundarysegments)-1
        if End > len(boundarysegments)-1:
            End = len(boundarysegments)-1
        
        # extract left and right boundaries by indices
        if Start == End:
            rml = self.RuntimeMessageLevel.Warning
            self.AddRuntimeMessage(rml, "Start index cannot be the same as " +
                                       "end index! Aborting...")
            return NullTree
        elif Start > End:
            Right = boundarysegments[End+1:Start]
            Left = boundarysegments[0:End] + boundarysegments[Start+1:]
        elif End > Start:
            Right = boundarysegments[Start+1:End]
            Left = boundarysegments[0:Start] + boundarysegments[End+1:]
        
        # extract start and end course polyline by index
        if FlipDir:
            StartCourse = boundarysegments[End]
            EndCourse = boundarysegments[Start]
        else:
            StartCourse = boundarysegments[Start]
            EndCourse = boundarysegments[End]
        
        # join the boundary curves
        if len(Left) > 0:
            LeftBoundary = list(Rhino.Geometry.Curve.JoinCurves(Left))[0]
        else:
            print StartCourse.PointAtEnd == EndCourse.PointAtStart
            raise NotImplementedError("Touching start and end courses are " +
                                      "not supported yet!")
        if len(Right) > 0:
            RightBoundary = list(Rhino.Geometry.Curve.JoinCurves(Right))[0]
        else:
            print StartCourse.PointAtStart == EndCourse.PointAtEnd
            raise NotImplementedError("Touching start and end courses are " +
                                      "not supported yet!")
        
        # StartBoundary startpoint
        ssp = StartCourse.PointAtStart
        # EndBoundary startpoint
        esp = EndCourse.PointAtStart
        # LeftBoundary startpoint
        lsp = LeftBoundary.PointAtStart
        # RightBoundary startpoint
        rsp = RightBoundary.PointAtStart
        
        # define maximum distance for boundary direction flipping as 10 * abstol
        md = Rhino.RhinoDoc.ActiveDoc.ModelAbsoluteTolerance
        md = md * 10
        
        # check for flipping of left and right boundaries
        lbsccp = StartCourse.ClosestPoint(lsp, md)
        rbsccp = StartCourse.ClosestPoint(rsp, md)
        if not lbsccp[0]:
            LeftBoundary.Reverse()
        if not rbsccp[0]:
            RightBoundary.Reverse()
        
        # check for flipping of start and end courses
        scrbcp = LeftBoundary.ClosestPoint(ssp, md)
        ecrbcp = LeftBoundary.ClosestPoint(esp, md)
        if not scrbcp[0]:
            StartCourse.Reverse()
        if not ecrbcp[0]:
            EndCourse.Reverse()
        
        # Break apart left and right boundaries again so we don't have to do
        # it yet again in the next step
        LeftBoundary = break_polyline(LeftBoundary.ToPolyline(),
                                      BreakAngle,
                                      as_crv=True)
        RightBoundary = break_polyline(RightBoundary.ToPolyline(),
                                       BreakAngle,
                                       as_crv=True)
        
        # set left and right for preview drawing
        self.SC = StartCourse
        self.EC = EndCourse
        self.LB = LeftBoundary
        self.RB = RightBoundary
        
        KC = KnitConstraint(StartCourse, EndCourse, LeftBoundary, RightBoundary)
        
        # DEPRECATED!
        # KnitConstraints = Grasshopper.DataTree[object]()
        # KnitConstraints.Add(StartCourse, Grasshopper.Kernel.Data.GH_Path(0))
        # KnitConstraints.Add(EndCourse, Grasshopper.Kernel.Data.GH_Path(1))
        # KnitConstraints.AddRange(LeftBoundary, Grasshopper.Kernel.Data.GH_Path(2))
        # KnitConstraints.AddRange(RightBoundary, Grasshopper.Kernel.Data.GH_Path(3))
        
        # return outputs if you have them; here I try it for you:
        return KC
# ---------- end ekcfomp ----------
knitconstraint_openpatch_2 = Data(ekcfomp)

# ----
# Tubular mesh example
# 
# Extract KnitConstraint
seamb = Slider(1, range=0..1)
seama = Slider(0, range=0..1)
knitmesh_tubular_2 = Mesh(knitmesh_tubular)
ekcftm = ExtractKnitConstraintsFromTubularMesh(Mesh=knitmesh_tubular_2, SeamA=seama, SeamB=seamb, FlipDir=Toggle(True))  # -> KnitConstraint; inputs Mesh: Mesh, FlipDir: Boolean
# ---------- ekcftm: Python ----------
"""
Extracts the necessary constraint to create KnitContours for a tubular mesh with
two closed boundaries based  on specified parameters. The constraints consist of
a start, end as well as a  left and right boundary. Preview shows the start
course in red, the end course in green and the left/right boundaries in blue.
    Inputs:
        Mesh: The mesh that should be knit for constraint extraction.
              {item, mesh}
        SeamA: Normalized position of the seam on the first closed boundary of
               the tube. Between 0.0 an 1.0.
               {item, float}
        SeamB: Normalized position of the seam on the second closed boundary of
               the tube. Between 0.0 an 1.0.
               {item, float}
        FlipDir: If True, inverts the knitting direction.
                 {item, bool}
    Output:
        KnitConstraint: The KnitConstraint for this mesh for contour
                        generation.
                        {item, KnitConstraint}
    Remarks:
        Author: Max Eschenbach
        License: MIT License
        Version: 200929
"""

# PYTHON STANDARD LIBRARY IMPORTS
from __future__ import division
import clr
from os import path

# GHPYTHON SDK IMPORTS
from ghpythonlib.componentbase import executingcomponent as component
import Grasshopper, GhPython
import System
import Rhino
import rhinoscriptsyntax as rs

# .NET IMPORTS
from System.Collections.Generic import List

# GHENV COMPONENT SETTINGS
ghenv.Component.Name = "ExtractKnitConstraintsFromTubularMesh"
ghenv.Component.NickName ="EKCFTM"
ghenv.Component.Category = "Cockatoo"
ghenv.Component.SubCategory = "04 Constraints"

# KANGAROO 2 IMPORT
k2import = False
try:
    clr.AddReferenceToFile("KangarooSolver.dll")
    k2import = True
except IOError:
    pass
if not k2import:
    try:
        clr.AddReferenceToFileAndPath(path.normpath(r"C:\Program Files\Rhino 7\Plug-ins\Grasshopper\Components\KangarooSolver.dll"))
        k2import = True
    except IOError:
        pass
if not k2import:
    try:
        clr.AddReferenceToFileAndPath(path.normpath(r"C:\Program Files\Rhino 7 WIP\Plug-ins\Grasshopper\Components\KangarooSolver.dll"))
        k2import = True
    except IOError:
        pass
if not k2import:
    try:
        clr.AddReferenceToFileAndPath(path.normpath(r"C:\Program Files\Rhino 6\Plug-ins\Grasshopper\Components\KangarooSolver.dll"))
    except IOError:
        raise RuntimeError("KangarooSolver.dll was not found! please add the " + \
                           "folder to your module search paths manually!")
import KangarooSolver as ks

# LOCAL MODULE IMPORTS
try:
    from cockatoo import KnitConstraint
    from cockatoo.utilities import break_polyline
except ImportError as e:
    errMsg = "The Cockatoo python module seems to be not correctly " + \
             "installed! Please make sure the module is in you search " + \
             "path, see README for instructions!."
    raise ImportError(errMsg)

class ExtractKnitConstraintsFromTubularMesh(component):
    
    def __init__(self):
        super(ExtractKnitConstraintsFromTubularMesh, self).__init__()
        self.SC = None
        self.EC = None
        self.SB = None
        self.RB = None
    
    def get_ClippingBox(self):
        return Rhino.Geometry.BoundingBox()
    
    def DrawViewportWires(self, args):
        try:
            # get display from args
            display = args.Display
            
            if self.SC and self.EC:
                # diplay colors for start and end in custom display
                scol = System.Drawing.Color.Red
                ecol = System.Drawing.Color.Green
                sbcol = System.Drawing.Color.SkyBlue
                # add start and end to customdisplay
                display.DrawCurve(self.SC, scol, 3)
                display.DrawCurve(self.EC, ecol, 3)
                display.DrawCurve(self.SB, sbcol, 2)
                display.DrawCurve(self.RB, sbcol, 2)
            
        except Exception, e:
            System.Windows.Forms.MessageBox.Show(str(e),
                                                 "Error while drawing preview!")
    
    def relax_polylines_on_mesh(self, polylines, mesh, kLineLength, kOnMesh, thres, iMax, tol):
        """Relax a bunch of polylines on a mesh as an approach to finding
        approximate geodesics on meshes.
        Based on an approach by Anders Holden Deleuran."""
        
        if iMax == 0:
            return polylines, 0
        else:
            # create the list of goals
            goals = []
            for i, pl in enumerate(polylines):
                # make show goal
                ghc = Grasshopper.Kernel.Types.GH_Curve(pl.ToPolylineCurve())
                gow = Grasshopper.Kernel.Types.GH_ObjectWrapper(ghc)
                goals.append(ks.Goals.Locator(gow))
                # make anchor goals
                plpts = pl.ToArray()
                goals.extend([ks.Goals.Anchor(a, 100000) for a in [plpts[0],
                                                                   plpts[-1]]])
                # make spring goals (line length)
                segs = pl.GetSegments()
                if len(segs) <= 10:
                    rml = Grasshopper.Kernel.GH_RuntimeMessageLevel.Remark
                    self.AddRuntimeMessage(rml, "Segment count is quite low! " +
                            "You might want to incerease this to find useful " +
                            "geodesics on the mesh.")
                for j, seg in enumerate(segs):
                    goals.append(ks.Goals.Spring(seg.From,
                                                 seg.To,
                                                 0.00,
                                                 kLineLength))
                # make onmesh goal with all points
                anchorList = List[Rhino.Geometry.Point3d]()
                [anchorList.Add(pt) for pt in plpts]
                goals.append(ks.Goals.OnMesh(anchorList, mesh, kOnMesh))
            
            # create physical system and dotnet list for goals
            ps = ks.PhysicalSystem()
            goalsList = List[ks.IGoal]()
            
            # assign particle indices automagically
            for g in goals:
                ps.AssignPIndex(g, tol)
                goalsList.Add(g)
            
            # solve the k2 physical system
            iterations = 0
            for i in range(iMax):
                ps.Step(goalsList, True, 1000)
                vs = ps.GetvSum()
                iterations += 1
                if vs <= thres:
                    break
            
            # get relaxed polylines from output
            geodesics = []
            for o in ps.GetOutput(goalsList):
                if type(o) is Rhino.Geometry.Polyline:
                    geodesics.append(o)
                    
            return geodesics, iterations
    
    def discretize_destination_line(self, line, mode, resolution):
        """Discretizes a destination line into a polyline with
        equally sized segments."""
        
        if mode == 0:
            division = round(resolution)
            if division == 0:
                division = 1
        elif mode == 1:
            division = math.ceil(line.Length / resolution)
            if division == 0:
                division = 1
        
        line = line.ToNurbsCurve()
        divT = list(line.DivideByCount(division, True))
        dPts = [line.PointAt(t) for t in divT]
        pl = Rhino.Geometry.Polyline(dPts)
        
        return pl
    
    def RunScript(self, Mesh, SeamA, SeamB, FlipDir, ):
        
        # define defaults and sanitize input
        if SeamA == None:
            SeamA = 0.5
        elif SeamA > 1:
            SeamA = 1.0
        elif SeamA < 0:
            SeamA = 0.0
        
        if SeamB == None:
            SeamB = 0.5
        elif SeamB > 1:
            SeamB = 1.0
        elif SeamB < 0:
            SeamB = 0.0
        
        # define empty tree placeholder output
        NullTree = Grasshopper.DataTree[object]()
        
        # catch missing inputs
        if not Mesh or SeamA == None or SeamB == None:
            if not Mesh:
                rml = self.RuntimeMessageLevel.Warning
                self.AddRuntimeMessage(rml, "No Mesh input!")
            return NullTree
        
        # get naked edges of the mesh boundary
        mesh_boundaries = list(Mesh.GetNakedEdges())
        if len(mesh_boundaries) > 2:
            errMsg = "Meshes with more than two closed " + \
                     "boundaries are not supported yet!"
            rml = self.RuntimeMessageLevel.Warning
            self.AddRuntimeMessage(rml, errMsg)
            return Grasshopper.DataTree[object]()
        
        mesh_boundary_curves = [pl.ToPolylineCurve() for pl in mesh_boundaries]
        
        # set start and end courses
        if FlipDir:
            StartCourse = mesh_boundary_curves[1]
            EndCourse = mesh_boundary_curves[0]
        else:
            StartCourse = mesh_boundary_curves[0]
            EndCourse = mesh_boundary_curves[1]
        
        # reparam domains
        StartCourse.Domain = Rhino.Geometry.Interval(0, 1)
        EndCourse.Domain = Rhino.Geometry.Interval(0, 1)
        
        # set seam
        StartCourse.ChangeClosedCurveSeam(SeamA)
        EndCourse.ChangeClosedCurveSeam(SeamB)
        
        # create destination line (seam of the knit, if you will)
        dest_a = StartCourse.PointAtStart
        dest_b = EndCourse.PointAtStart
        dest_line = Rhino.Geometry.Line(dest_a, dest_b)
        dest_line = self.discretize_destination_line(dest_line,
                                                     0,
                                                     100)
        
        tol = Rhino.RhinoDoc.ActiveDoc.ModelAbsoluteTolerance
        seam_line = self.relax_polylines_on_mesh(
                                            [dest_line],
                                            Mesh,
                                            10,
                                            100,
                                            1e-14,
                                            1000,
                                            tol)[0][0].ToPolylineCurve()
        
        LeftBoundary = seam_line
        RightBoundary = seam_line.Duplicate()
        
        # set left and right for preview drawing
        self.SC = StartCourse
        self.EC = EndCourse
        self.SB = LeftBoundary
        self.RB = RightBoundary
        
        KC = KnitConstraint(StartCourse,
                            EndCourse,
                            [LeftBoundary],
                            [RightBoundary])
        
        # return outputs if you have them; here I try it for you:
        return KC
# ---------- end ekcftm ----------
knitconstraint_tubular = Data(ekcftm)

# ----
# Mesh patch
# 
# Extract KnitConstraint (variation 2)
breakangle_2 = Slider(32, range=0..100)
end_2 = Slider(1, range=0..10)
start_2 = Slider(3, range=0..20)
knitmesh_openpatch_4 = Mesh(knitmesh_openpatch)
flipdir_2 = BooleanToggle(True)
rad_3 = Radians(Degrees=breakangle_2)
ekcfomp_2 = ExtractKnitConstraintsFromOpenMeshPatch(Mesh=knitmesh_openpatch_4, BreakAngle=rad_3, Start=start_2, End=end_2, FlipDir=flipdir_2)  # -> KnitConstraint; inputs Mesh: Mesh, Start: Int32, End: Int32, FlipDir: Boolean; same code as ekcfomp
knitconstraint_openpatch_3 = Data(ekcfomp_2)

# ----
# Create contours based
# on KnitConstraint
contourdivisiondensity = Slider(80, range=0.1..1000)
contourdensity = Slider(40, range=0.1..1000)
geodesicstrength = Slider(1000, range=0..2000)
contourdivisionmode = ValueList({"Relative": 0, "Absolute": 1}, selected="Relative")
tweenstrength = Slider(5, range=0..3000)
maxiterations = Slider(100, range=0..1000)
tolerance = Slider(0.001, range=1e-05..1)
contourmode = ValueList({"Relative": 0, "Absolute": 1}, selected="Relative")
run = BooleanToggle(True)
knitconstraint_tubular_2 = Data(knitconstraint_tubular)
knitmesh_tubular_3 = Mesh(knitmesh_tubular_2)
kcom = KnitContoursOnMesh(
    Run=run,
    Mesh=knitmesh_tubular_3,
    KnitConstraint=knitconstraint_tubular_2,
    ContourDensity=contourdensity,
    ContourMode=contourmode,
    ContourDivisionDensity=contourdivisiondensity,
    ContourDivisionMode=contourdivisionmode,
    GeodesicStrength=geodesicstrength,
    TweenStrength=tweenstrength,
    MaxIterations=maxiterations,
    Tolerance=tolerance)  # -> KnitContours; inputs Run: Boolean, Mesh: Mesh, ContourMode: Int32, ContourDivisionMode: Int32, MaxIterations: Int32
# ---------- kcom: Python ----------
"""
Constructs contours for deriving a knitting pattern from a mesh. Use the
GeodesicStrength and TweenStrength inputs to control the shape and distribution
of the contour curves on the mesh.
---
Based on an approach for geodesics by Anders Holden Deleuran
https://discourse.mcneel.com/t/geodesic-lines-on-a-mesh/58790/4
    Inputs:
        Run: Set to True to activate the component. Connect a boolean toggle
             ideally.
             {item, bool}
        Mesh: The mesh to create the contours on.
              {item, mesh}
        KnitConstraints: The Cockatoo KnitConstraints defining the direction and
                         limits of the contours.
                         {item, float}
        ContourDensity: The density (i.e. amount) of the contour curves.
                        {item, int/float}
        ContourMode: How to interpret the ContourDensity input.
                     [0] = Relative - ContourDensity sets the total number of
                           contour curves.
                     [1] = Absolute - ContourDensity sets the target distance
                         between the contour curves.
                     {item, integer}
        ContourDivisionDensity: The resolution (i.e. division count) of the
                                contour curves.
                                {item, int/float}
        ContourDivisionMode: How to interpret the ContourDivisionDensity input.
                             [0] = Relative - ContourDivisionDensity sets the
                                 total num of divisions for the contour curves.
                             [1] = Absolute - ContourDivisionDensity sets the
                                 target segment length of the contour curves.
                             {item, int/float}
        GeodesicStrength: Strength of the internal Kangaroo2 goal minimizing the
                          length of the contour curves. Defaults to 1000.
                          {item, int}
        TweenStrength: Strength of the internal Kangaroo2 goal controlling the
                       distribution of the contours. Defaults to 2000.
                       {item, int}
        MaxIterations: The maximum number of iterations for the internal
                       Kangaroo2 solver.
                       {item, int}
        Tolerance: The tolerance of the internal Kangaroo2 solver.
                   Defaults to 1e-6.
                   {item, int}
        Threshold: The threshold for the internal Kangaroo2 solver.
                   Defaults to 1e-14.
                   {item, int}
    Output:
        KnitContours: The KnitContour curves on the mesh for initializing a
                      KnitNetwork and deriving a knitting pattern.
                      {item, polyline}
    Remarks:
        Author: Max Eschenbach
        License: MIT License
        Version: 200705
"""

# PYTHON STANDARD LIBRARY IMPORTS
from __future__ import division
import clr
import os

# .NET IMPORTS
from System.Collections.Generic import List

# GHPYTHON SDK IMPORTS
from ghpythonlib.componentbase import executingcomponent as component
import Grasshopper, GhPython
import System
import Rhino
import rhinoscriptsyntax as rs

# GHENV COMPONENT SETTINGS
ghenv.Component.Name = "KnitContoursOnMesh"
ghenv.Component.NickName ="KCOM"
ghenv.Component.Category = "Cockatoo"
ghenv.Component.SubCategory = "05 Contouring"

# KANGAROO 2 IMPORT
if "KangarooSolver" in str(clr.References):
    import KangarooSolver as ks
else:
    try:
        rhino_version = Rhino.RhinoApp.ExeVersion
        if os.name == "nt":
            if rhino_version == 6:
                k2ap = ("C:/Program Files/Rhino 6/Plug-ins/Grasshopper/"
                        "Components/KangarooSolver.dll")
                clr.AddReferenceToFileAndPath(os.path.normpath(k2ap))
            elif rhino_version == 7:
                k2ap = ("C:/Program Files/Rhino 7/Plug-ins/Grasshopper/"
                        "Components/KangarooSolver.dll")
                if not os.path.exists(k2ap):
                    k2ap = ("C:/Program Files/Rhino 7 WIP/Plug-ins/Grasshopper/"
                            "Components/KangarooSolver.dll")
                clr.AddReferenceToFileAndPath(os.path.normpath(k2ap))
        elif os.name == "posix":
            k2ap = (r"/Applications/Rhinoceros.app/Contents/Frameworks/"
                      "RhCore.framework/Versions/A/Resources/ManagedPlugIns/"
                      "GrasshopperPlugin.rhp/Components/KangarooSolver.dll")
            clr.AddReferenceToFileAndPath(os.path.normpath(k2ap))
        import KangarooSolver as ks
    except (IOError, ImportError):
        try:
            clr.AddReferenceToFile("KangarooSolver.dll")
            import KangarooSolver as ks
        except (IOError, ImportError):
            raise RuntimeError("KangarooSolver.dll was not found! "
                               "please add the folder to your module "
                               "search paths manually!")

# LOCAL MODULE IMPORTS
try:
    import cockatoo
except ImportError:
    errMsg = "The Cockatoo python module seems to be not correctly " + \
             "installed! Please make sure the module is in you search " + \
             "path, see README for instructions!."
    raise ImportError(errMsg)

class KnitContoursOnMesh(component):
    
    def relax_contours_on_mesh(self, polylines, mesh, kLineLengthA, kLineLengthB, kEqualize, kOnMesh, thres, iMax, tol):
        """
        Relax a bunch of contour lines on a mesh.
        Based on an approach by Anders Holden Deleuran.
        """
        
        EQMODE = 0
        
        if iMax == 0:
            return polylines, 0
        else:
            # create the list of goals
            goals = []
            if EQMODE == 0:
                eqLines = List[Rhino.Geometry.Curve]()
            elif EQMODE == 1:
                eqLines = [List[Rhino.Geometry.Curve]() \
                           for x in range(len(polylines))]
            for i, pl in enumerate(polylines):
                # make show goal
                ghc = Grasshopper.Kernel.Types.GH_Curve(pl.ToPolylineCurve())
                gow = Grasshopper.Kernel.Types.GH_ObjectWrapper(ghc)
                goals.append(ks.Goals.Locator(gow))
                
                # make anchor goals
                plpts = pl.ToArray()
                if i == 0 or i == (len(polylines) - 1):
                    goals.extend([ks.Goals.Anchor(pt, 10000000) for pt in plpts])
                else:
                    goals.extend([ks.Goals.Anchor(a, 10000000) for a in [plpts[0],
                                                                   plpts[-1]]])
                
                # make spring goals (line length)
                segs = pl.GetSegments()
                
                # get next segments
                y = i + 1
                if y <= len(polylines) - 1:
                    nextsegs = polylines[y].GetSegments()
                else:
                    nextsegs = None
                
                for j, seg in enumerate(segs):
                    goals.append(ks.Goals.Spring(seg.From,
                                                 seg.To,
                                                 0.00,
                                                 kLineLengthA))
                    
                    if nextsegs:
                        goals.append(ks.Goals.Spring(seg.From,
                                                     nextsegs[j].From,
                                                     0.00,
                                                     kLineLengthB))
                        if kEqualize:
                            # create the equal length line
                            eqln = Rhino.Geometry.LineCurve(seg.From,
                                                            nextsegs[j].From)
                            if EQMODE == 0:
                                eqLines.Add(eqln)
                            elif EQMODE == 1:
                                eqLines[0].Add(eqln)
                
                # make onmesh goal with all points
                anchorList = List[Rhino.Geometry.Point3d]()
                [anchorList.Add(pt) for pt in plpts]
                goals.append(ks.Goals.OnMesh(anchorList, mesh, kOnMesh))
            
            # create equallength goal
            if kEqualize:
                if EQMODE == 0:
                    goals.append(ks.Goals.EqualLength(eqLines, kEqualize))
                elif EQMODE == 1:
                    for eqLine in eqLines:
                        goals.append(ks.Goals.EqualLength(eqLine, kEqualize))
            
            # create physical system and dotnet list for goals
            ps = ks.PhysicalSystem()
            goalsList = List[ks.IGoal]()
            
            # assign particle indices automagically
            for g in goals:
                ps.AssignPIndex(g, tol)
                goalsList.Add(g)
            
            # solve the k2 physical system
            iterations = 0
            for i in range(iMax):
                ps.Step(goalsList, True, 1000.0)
                vs = ps.GetvSum()
                iterations += 1
                if vs <= thres:
                    break
            
            # get relaxed polylines from output
            contours = []
            for o in ps.GetOutput(goalsList):
                if type(o) is Rhino.Geometry.Polyline:
                    contours.append(o)
                    
            return contours, iterations
    
    def get_segment_ratios(self, segments):
        """
        Get the length ratios for the given segment relative to their overall
        length.
        """
        
        overall_length = sum([seg.GetLength() for seg in segments])
        
        seg_ratios = [(seg.GetLength() / overall_length) for seg in segments]
        
        return overall_length, seg_ratios
    
    def create_contours(self, KMCList, ContourDensity, ContourDivisionDensity, ContourMode, ContourDivisionMode):
        
        # unpack the kmclist
        StartCourse, EndCourse, LeftBoundary, RightBoundary = KMCList
        
        # GET SEGMENTATION RATIOS ----------------------------------------------
        
        stLen, sRat = self.get_segment_ratios([StartCourse])
        etLen, eRat = self.get_segment_ratios([EndCourse])
        ltLen, lbRat = self.get_segment_ratios(LeftBoundary)
        rtLen, rbRat = self.get_segment_ratios(RightBoundary)
        
        # SET SAMPLING DENSITY -------------------------------------------------
        
        if ContourMode == 0:
            ContourDensity = int(ContourDensity)
        elif ContourMode == 1:
            ContourDensity = int(round(max([stLen, etLen])/ContourDensity))
        
        if ContourDivisionMode == 0:
            ContourDivisionDensity = int(ContourDivisionDensity)
        elif ContourDivisionMode == 1:
            ContourDivisionDensity = int(round(max([ltLen, rtLen])/ContourDivisionDensity))
        
        # COMPUTE DIVISIONS FOR LEFT AND RIGHT BOUNDARY SEGMENTS ---------------
        
        # get left boundary divisions
        lbDiv = [int(round(rat*int(ContourDivisionDensity))) for rat in lbRat]
        lbSum = sum(lbDiv)
        if 0 in lbDiv:
            for i, val in enumerate(lbDiv):
                if val == 0:
                    lbDiv[i] += 1
                if val == max(lbDiv):
                    lbDiv[i] -= 1
        if lbSum != ContourDivisionDensity:
            dlt = int(ContourDivisionDensity - lbSum)
            for i, val in enumerate(lbDiv):
                if val == max(lbDiv):
                    lbDiv[i] += dlt
                    break
        
        # get right boundary divisions
        rbDiv = [int(round(rat*int(ContourDivisionDensity))) for rat in rbRat]
        rbSum = sum(rbDiv)
        if 0 in rbDiv:
            for i, val in enumerate(rbDiv):
                if val == 0:
                    rbDiv[i] += 1
                if val == max(rbDiv):
                    rbDiv[i] -= 1
        if rbSum != ContourDivisionDensity:
            dlt = int(ContourDivisionDensity - rbSum)
            for i, val in enumerate(rbDiv):
                if val == max(rbDiv):
                    rbDiv[i] += dlt
                    break
        
        # raise errors if input is wrong
        if not sum(lbDiv) == sum(rbDiv) == ContourDivisionDensity:
            if ContourDivisionMode == 0:
                raise ValueError("Sampling density for left and right is too " +
                                 "low for number of left or right segments! " +
                                 "Try increasing the density.")
            elif ContourDivisionMode == 1:
                raise ValueError("Sampling distance for left and right is " +
                                 "too high for number of left or right " +
                                 "segments! Try decreasing the distance.")
        
        # divide all left boundary segments with their matching segment count
        lpt = []
        for i, segment in enumerate(LeftBoundary):
            segment.Domain = Rhino.Geometry.Interval(0, 1)
            segT = segment.DivideByCount(lbDiv[i], True)
            segPt = [segment.PointAt(t) for t in segT]
            [lpt.append(p) for p in segPt if p not in lpt]
        
        # divide all right boundary segments with their matching segment count
        rpt = []
        for i, segment in enumerate(RightBoundary):
            segment.Domain = Rhino.Geometry.Interval(0, 1)
            segT = segment.DivideByCount(rbDiv[i], True)
            segPt = [segment.PointAt(t) for t in segT]
            [rpt.append(p) for p in segPt if p not in rpt]
        
        # GET SEGMENTATION RATIOS FOR START AND END BOUNDARY -------------------
        
        # get start boundary divisions
        sDiv = [int(round(rat*int(ContourDensity))) for rat in sRat]
        sSum = sum(sDiv)
        if 0 in sDiv:
            for i, val in enumerate(sDiv):
                if val == 0:
                    sDiv[i] += 1
                if val == max(sDiv):
                    sDiv[i] -= 1
        if sSum != ContourDensity:
            dlt = int(ContourDensity - sSum)
            for i, val in enumerate(sDiv):
                if val == max(sDiv):
                    sDiv[i] += dlt
                    break
        
        # get end boundary divisions
        eDiv = [int(round(rat*int(ContourDensity))) for rat in eRat]
        eSum = sum(eDiv)
        if 0 in eDiv:
            for i, val in enumerate(eDiv):
                if val == 0:
                    eDiv[i] += 1
                if val == max(eDiv):
                    eDiv[i] -= 1
        if eSum != ContourDensity:
            dlt = int(ContourDivisionDensity - eSum)
            for i, val in enumerate(eDiv):
                if val == max(eDiv):
                    eDiv[i] += dlt
                    break
        
        # raise errors if input is wrong
        if not sum(sDiv) == sum(eDiv) == ContourDensity:
            if ContourMode == 0:
                raise ValueError("Sampling density for start and end is too " +
                                 "low for number of start or end segments! " +
                                 "Try increasing the density.")
            elif ContourMode == 1:
                raise ValueError("Sampling distance for start and end is too " +
                                 "high for number of start or end segments! " +
                                 "Try decreasing the distance.")
        
        # divide all start boundary segments with their matching segment count
        spt = []
        for i, segment in enumerate([StartCourse]):
            segment.Domain = Rhino.Geometry.Interval(0, 1)
            segT = segment.DivideByCount(sDiv[i], True)
            segPt = [segment.PointAt(t) for t in segT]
            [spt.append(p) for p in segPt if p not in spt]
        spt = spt[1:-1]
        
        # divide all right boundary segments with their matching segment count
        ept = []
        for i, segment in enumerate([EndCourse]):
            segment.Domain = Rhino.Geometry.Interval(0, 1)
            segT = segment.DivideByCount(eDiv[i], True)
            segPt = [segment.PointAt(t) for t in segT]
            [ept.append(p) for p in segPt if p not in ept]
        ept = ept[1:-1]
        
        # CREATE DESTIONATION LINES AND SAMPLE THEM ----------------------------
        
        # build destination lines
        destinations = []
        for i, pt in enumerate(spt):
            ln = Rhino.Geometry.LineCurve(pt, ept[i])
            destinations.append(ln)
        
        # sample destination lines
        for i, d in enumerate(destinations):
            d.Domain = Rhino.Geometry.Interval(0, 1)
            dt = d.DivideByCount(ContourDivisionDensity, True)
            dpts = [d.PointAt(t) for t in dt]
            destinations[i] = Rhino.Geometry.PolylineCurve(dpts)
        
        # CREATE FINAL LIST OF CONTOURS ----------------------------------------
        
        Contours = [Rhino.Geometry.PolylineCurve(lpt)]
        Contours.extend(destinations)
        Contours.append(Rhino.Geometry.PolylineCurve(rpt))
        for i, c in enumerate(Contours):
            Contours[i] = c.TryGetPolyline()[1]
        
        return Contours
    
    def RunScript(self, Run, Mesh, KnitConstraint, ContourDensity, ContourMode, ContourDivisionDensity, ContourDivisionMode, GeodesicStrength, TweenStrength, MaxIterations, Tolerance, Threshold):
        
        # INITIALIZATION -------------------------------------------------------
        
        # sanitize ContourMode input
        if ContourMode == None:
            ContourMode = 0
        elif ContourMode < 0:
            ContourMode = 0
        elif ContourMode > 1:
            ContourMode = 1
        
        # sanitize ContourDivisionMode input
        if ContourDivisionMode == None:
            ContourDivisionMode = 0
        elif ContourDivisionMode < 0:
            ContourDivisionMode = 0
        elif ContourDivisionMode > 1:
            ContourDivisionMode = 1
        
        # set default for maximum iterations
        if MaxIterations == None:
            MaxIterations = 100
        
        # set default tolerance
        if Tolerance == None:
            Tolerance = 1e-6
        
        # set default Threshold
        if not Threshold:
            Threshold = 1e-14
        
        if GeodesicStrength == None:
            GeodesicStrength = 1000
        if TweenStrength == None:
            TweenStrength = 2000
        
        EqualizeStrength = 0
        OnMeshStrength = 100000
        
        NullTree = Grasshopper.DataTree[object]()
        
        # DEACTIVATED CONDITION ------------------------------------------------
        
        if not Run or not Mesh or not KnitConstraint:
            self.Message = "Deactivated"
            if not Mesh:
                rml = self.RuntimeMessageLevel.Warning
                self.AddRuntimeMessage(rml, "No Mesh input!")
            if not KnitConstraint:
                rml = self.RuntimeMessageLevel.Warning
                self.AddRuntimeMessage(rml, "No KnitConstraint input!")
            return NullTree
        
        # UNPACK CONSTRAINTS ---------------------------------------------------
        
        StartCourse = KnitConstraint.start_course
        EndCourse = KnitConstraint.end_course
        LeftBoundary = KnitConstraint.left_boundary
        RightBoundary = KnitConstraint.right_boundary
        
        KMCList = [StartCourse, EndCourse, LeftBoundary, RightBoundary]
        
        # SAMPLE INPUT AND CREATE CONTOURS -------------------------------------
        
        Contours = self.create_contours(KMCList,
                                       ContourDensity,
                                       ContourDivisionDensity,
                                       ContourMode,
                                       ContourDivisionMode)
        
        # RELAX CONTOUR CURVES ON THE MESH -------------------------------------
        
        Contours, Iterations = self.relax_contours_on_mesh(Contours,
                                                        Mesh,
                                                        GeodesicStrength,
                                                        TweenStrength,
                                                        EqualizeStrength,
                                                        OnMeshStrength,
                                                        Threshold,
                                                        MaxIterations, 
                                                        Tolerance)
        
        # SET COMPONENT MESSAGE ------------------------------------------------
        
        if Iterations < MaxIterations:
            self.Message = "Converged after {} iterations".format(Iterations)
        else:
            self.Message = "Stopped after {} iterations".format(Iterations)
        
        # RETURN OUTPUTS -------------------------------------------------------
        
        return Contours
# ---------- end kcom ----------
knitcontours_tubular = Data(kcom)

# ----
# Create contours based
# on KnitConstraint
number_slider = Slider(40, range=0..100)
knitconstraint_openpatch_4 = Data(knitconstraint_openpatch_2)
knitmesh_openpatch_5 = Mesh(knitmesh_openpatch)
hmkcom = HeatMethodKnitContoursOnMesh(
    ReferenceMesh=knitmesh_openpatch_5,
    KnitConstraint=knitconstraint_openpatch_4,
    Threshold="1e-14",
    MaxIterations=Slider(5000, range=0..10000),
    ContourCount=number_slider,
    Reference="C:\Program Files\Rhino 7\Plug-ins\Grasshopper\Components\KangarooSolver.dll")  # -> Mesh, Values, Gradient, KnitContours; inputs ReferenceMesh: Mesh, IsoFixGuides: list of Polyline, Threshold: Double, MaxIterations: Int32, ContourCount: Int32
# ---------- hmkcom: C# usings ----------
using System.Linq;
using System.Threading.Tasks;
using KPlankton;
# ---------- hmkcom: C# ----------
    /*
    Original Script by Daniel Piker 03/07/2020
    Modified by Max Eschenbach May 2021
    version 210929
    */

    // set component params
    this.Component.Name = "HeatMethodKnitContoursOnMesh";
    this.Component.NickName = "HMKCOM";
    this.Component.Category = "Cockatoo";
    this.Component.SubCategory = "05 Contouring";
    this.Component.Description = "Constructs contours for deriving a knitting pattern from a mesh using the Heat Method. Use the GuideCurves input to influence the contouring. NOTE: EXPERIMENTAL COMPONENT! Based on a script by Daniel Piker. See: https://discourse.mcneel.com/t/heat-method/105135";

    // set param descriptions
    this.Component.Params.Input[0].Description = "The mesh to create the contours on. {item, mesh}";
    this.Component.Params.Input[1].Description = "The Cockatoo KnitConstraint defining the direction and limits of the contours. {item, KnitConstraint}";
    this.Component.Params.Input[2].Description = "The guide curves for influencing the heat distribution and thus the contour generation. NOTE: Guide Curves must be Polylines and its Vertices must be included in the Mesh! This will be enhanced in a coming update. {list, Polyline}";
    this.Component.Params.Input[3].Description = "The threshold where the heat method will stop iterating. Defaults to 1e-6. {item, double}";
    this.Component.Params.Input[4].Description = "The maximum number of iterations for the internal Heat Method solver. Defaults to 5000. {item, int}";
    this.Component.Params.Input[5].Description = "The number of contour curves to create. Defaults to 20.{item, int}";

    // set defaults
    bool abort = false;
    if (ReferenceMesh == null)
    {
      this.Component.AddRuntimeMessage(GH_RuntimeMessageLevel.Warning,
        "Input Parameter ReferenceMesh failed to collect data!");
      abort = true;
    }
    if (KnitConstraint == null)
    {
      this.Component.AddRuntimeMessage(GH_RuntimeMessageLevel.Warning,
        "Input Parameter KnitConstraint failed to collect data!");
      abort = true;
    }
    if (Threshold == 0) Threshold = 1e-6;
    if (MaxIterations == 0) MaxIterations = 5000;
    if (ContourCount == 0) ContourCount = 20;
    if (abort)
    {
      Mesh = new DataTree<Object>();
      Values = new DataTree<Object>();
      Gradient = new DataTree<Object>();
      KnitContours = new DataTree<Object>();
      return;
    }

    // init variables
    double[] values;
    double[][] storedweights;
    int[][] storedneighbours;
    Vector3d[] gradient;
    Vector3d[] edgeGradient;
    int[] fix;
    int[][] equalize;
    Mesh ResultMesh;

    // init vars for threshold tracking
    double heat_avg = 0;
    double poisson_avg = 0;
    bool converged = false;

    // EXTRACT DATA FROM KNITCONSTRAINT ------------------------------------

    dynamic KC = KnitConstraint;
    var StartCourse = KC.start_course;
    var EndCourse = KC.end_course;
    dynamic LeftBoundary = KC.left_boundary;
    dynamic RightBoundary = KC.right_boundary;

    // points of the left boundary are heatpoints
    List<Point3d> HeatPoints = new List<Point3d>();
    foreach (PolylineCurve plc in LeftBoundary)
    {
      Polyline pl = plc.ToPolyline();
      foreach (Point3d pt in pl) HeatPoints.Add(pt);
    }
    Polyline HeatPoly = new Polyline(HeatPoints);
    IsoFixGuides.Add(HeatPoly);

    // points of the right boundary are coldpoints
    List<Point3d> ColdPoints = new List<Point3d>();
    foreach (PolylineCurve plc in RightBoundary)
    {
      Polyline pl = plc.ToPolyline();
      foreach (Point3d pt in pl) ColdPoints.Add(pt);
    }
    Polyline ColdPoly = new Polyline(ColdPoints);
    IsoFixGuides.Add(ColdPoly);

    // INITIALIZE HEAT METHOD -----------------------------------------------

    // convert all quads to triangles
    ReferenceMesh.Faces.ConvertQuadsToTriangles();

    // get kplankton mesh
    KPlanktonMesh ReferencePMesh = KPlankton.RhinoSupport.ToKPlanktonMesh(ReferenceMesh);

    int vc = ReferencePMesh.Vertices.Count;
    storedweights = new double[vc][];
    storedneighbours = new int[vc][];
    values = new double[vc];
    fix = new int[vc];
    equalize = new int[IsoFixGuides.Count][];
    for(int i = 0;i < vc;i++)
    {
      storedweights[i] = ComputeCotanWeights(ReferencePMesh, i);
      storedneighbours[i] = ReferencePMesh.Vertices.GetVertexNeighbours(i);
      for(int j = 0;j < HeatPoints.Count;j++)
      {
        if(ReferencePMesh.Vertices[i].ToPoint3d().DistanceTo(HeatPoints[j]) < Rhino.RhinoDoc.ActiveDoc.ModelAbsoluteTolerance)
        {
          values[i] = 1;
          fix[i] = 1;
        }
      }
      for(int j = 0;j < ColdPoints.Count;j++)
      {
        if(ReferencePMesh.Vertices[i].ToPoint3d().DistanceTo(ColdPoints[j]) < Rhino.RhinoDoc.ActiveDoc.ModelAbsoluteTolerance)
        {
          values[i] = 0;
          fix[i] = 2;
        }
      }
    }

    for(int i = 0;i < IsoFixGuides.Count;i++)
    {
      Polyline thisPoly = IsoFixGuides[i];
      int polyCount = thisPoly.Count;
      if(thisPoly[thisPoly.Count - 1].Equals(thisPoly[0])) polyCount--;//don't count first point twice for closed curves
      equalize[i] = new int[polyCount];
      for(int j = 0;j < polyCount;j++)
      {
        for(int k = 0;k < vc;k++)
        {
          if(ReferencePMesh.Vertices[k].ToPoint3d().DistanceTo(thisPoly[j]) < Rhino.RhinoDoc.ActiveDoc.ModelAbsoluteTolerance)
          {
            equalize[i][j] = k;
            break;
          }
        }
      }
    }

    gradient = new Vector3d[vc];
    ResultMesh = ReferenceMesh.DuplicateMesh();

    edgeGradient = null;

    // HEAT DIFFUSION -----------------------------------------------------

    for(int k = 0; k < MaxIterations; k++)
    {
      double[] newValues = new double[values.Length];
      Parallel.For(0, ReferencePMesh.Vertices.Count,
        i => {

        if(fix[i] == 0)
        {
          int[] neighbours = storedneighbours[i];
          double[] weights = storedweights[i];
          double newValue = 0;
          for(int j = 0;j < neighbours.Length;j++)
          {
            newValue += weights[j] * values[neighbours[j]];
          }
          newValues[i] = newValue;
        }
        else newValues[i] = values[i];
        });

      for(int i = 0; i < equalize.Length; i++)
      {
        double avg = 0;
        for(int j = 0;j < equalize[i].Length;j++)avg += newValues[equalize[i][j]];
        avg /= equalize[i].Length;
        for(int j = 0;j < equalize[i].Length;j++) newValues[equalize[i][j]] = avg;
      }
      values = newValues;

      // track average heat value change
      double this_heat_avg = System.Linq.Enumerable.Average(values);
      double heat_avg_change = Math.Abs(this_heat_avg - heat_avg);
      heat_avg = this_heat_avg;

      if (heat_avg <= Threshold) break;
    }

    double min = values.Min();
    double max = values.Max();
    double mult = 1.0 / (max - min);
    for(int i = 0;i < values.Length;i++) values[i] = mult * (values[i] - min);

    edgeGradient = null;

    // POISSON AVERAGING --------------------------------------------------

    if(edgeGradient == null)
    {
      gradient = ComputeGradients(ReferencePMesh, values);
      double avgGradientLength = 0;
      for(int i = 0;i < gradient.Length;i++)
      {
        avgGradientLength += gradient[i].Length;
      }
      avgGradientLength /= gradient.Length;

      edgeGradient = new Vector3d[ReferencePMesh.Halfedges.Count / 2];
      for(int i = 0;i < ReferencePMesh.Halfedges.Count / 2;i++)
      {
        int start = ReferencePMesh.Halfedges[2 * i].StartVertex;
        int end = ReferencePMesh.Halfedges[(2 * i) + 1].StartVertex;
        Vector3d sv = gradient[start];
        Vector3d ev = gradient[end];
        Vector3d thisEdgeGradient = sv + ev;
        thisEdgeGradient.Unitize();
        thisEdgeGradient *= avgGradientLength;
        edgeGradient[i] = thisEdgeGradient;
      }
    }

    for(int k = 0; k < MaxIterations; k++)
    {
      double[] heChange = new double[ReferencePMesh.Halfedges.Count];
      Parallel.For(0, ReferencePMesh.Halfedges.Count / 2,
        i => {
        int start = ReferencePMesh.Halfedges[2 * i].StartVertex;
        int end = ReferencePMesh.Halfedges[(2 * i) + 1].StartVertex;
        Vector3d edgeVector = ReferencePMesh.Vertices[end].ToPoint3d() - ReferencePMesh.Vertices[start].ToPoint3d();
        double projected = edgeVector * edgeGradient[i];
        double currentDifference = values[end] - values[start];
        double change = currentDifference - projected;
        heChange[2 * i] = 1 * change;
        heChange[(2 * i) + 1] = -1 * change;
        });

      Parallel.For(0, ReferencePMesh.Vertices.Count,
        i => {
        {
          {
            double[] weights = storedweights[i];
            int[] halfedges = ReferencePMesh.Vertices.GetHalfedges(i);
            for(int j = 0;j < halfedges.Length;j++)
            {
              values[i] += heChange[halfedges[j]] * weights[j];
            }
          }
        }
        });

      double this_poisson_avg = 0;
      for(int i = 0;i < equalize.Length;i++)
      {
        double avg = 0;
        for(int j = 0;j < equalize[i].Length;j++)avg += values[equalize[i][j]];
        avg /= equalize[i].Length;
        for(int j = 0;j < equalize[i].Length;j++) values[equalize[i][j]] = avg;
        this_poisson_avg = avg;
      }

      // track average value change for poisson step
      double poisson_avg_change = Math.Abs(this_poisson_avg - poisson_avg);
      poisson_avg = this_poisson_avg;

      if (poisson_avg_change <= Threshold)
      {
        converged = true;
        break;
      }
    }

    this.Component.Message = (converged) ? "Converged" : "MaxIterations reached!";

    // SET TEXTURE COORDINATES ----------------------------------------------

    for(int i = 0;i < ResultMesh.Vertices.Count;i++)
    {
      ResultMesh.TextureCoordinates.SetTextureCoordinate(i, new Point2f(0, (float) (values[i] * 7.0)));
    }

    // CONTOUR GENERATION ----------------------------------------------------

    KnitContours = CreateKnitContours(ResultMesh,
      StartCourse,
      EndCourse,
      HeatPoly.ToPolylineCurve(),
      ColdPoly.ToPolylineCurve(),
      ContourCount - 2);

    // OUTPUT ----------------------------------------------------------------

    // input mesh with adjusted texture coordinates
    Mesh = ResultMesh;
    // the scalar values and gradient vectors per vertex
    Values = values;
    Gradient = gradient;
# ---------- hmkcom: C# additional code ----------
  private static Vector3d[] ComputeGradients(KPlanktonMesh KPM, double[] values)
  {
    // compute halfedge gradients
    Vector3d[] halfedgeGradients = new Vector3d[KPM.Halfedges.Count];
    for(int i = 0;i < KPM.Halfedges.Count / 2;i++)
    {
      int start = KPM.Halfedges[2 * i].StartVertex;
      int end = KPM.Halfedges[2 * i + 1].StartVertex;
      Vector3d v = KPM.Vertices[end].ToPoint3d() - KPM.Vertices[start].ToPoint3d();
      double lengthSquared = v.SquareLength;
      double diff = values[end] - values[start];
      Vector3d edgeGradient = v * (diff / lengthSquared);
      halfedgeGradients[2 * i] = halfedgeGradients[2 * i + 1] = edgeGradient;
    }

    // compute vertex gradients from halfedge gradients
    Vector3d[] vertexGradients = new Vector3d[KPM.Vertices.Count];
    for(int i = 0;i < KPM.Vertices.Count;i++)
    {
      double[] weights = ComputeCotanWeights(KPM, i);
      Vector3d gradient = new Vector3d();
      int[] halfedges = KPM.Vertices.GetHalfedges(i);
      for(int j = 0;j < halfedges.Length;j++)
      {
        gradient += halfedgeGradients[halfedges[j]] * weights[j];
      }
      vertexGradients[i] = gradient;
    }
    return vertexGradients;
  }

  private static double[] ComputeCotanWeights(KPlanktonMesh KPM, int i)
  {
    int[] Neighbours = KPM.Vertices.GetVertexNeighbours(i);
    Point3d Vertex = KPM.Vertices[i].ToPoint3d();
    int valence = KPM.Vertices.GetValence(i);
    Point3d[] NeighbourPts = new Point3d[valence];
    Vector3d[] Radial = new Vector3d[valence];
    Vector3d[] Around = new Vector3d[valence];
    double[] CotWeight = new double[valence];
    double WeightSum = 0;
    for (int j = 0; j < valence; j++)
    {
      NeighbourPts[j] = KPM.Vertices[Neighbours[j]].ToPoint3d();
      Radial[j] = NeighbourPts[j] - Vertex;
    }
    for (int j = 0; j < valence; j++)
    {
      Around[j] = NeighbourPts[(j + 1) % valence] - NeighbourPts[j];
    }
    int[] halfEdges = KPM.Vertices.GetHalfedges(i);
    for (int j = 0; j < Neighbours.Length; j++)
    {
      int previous = (j + valence - 1) % valence;
      int next = (j + 1) % valence;

      Vector3d Cross1 = Vector3d.CrossProduct(Radial[previous], Around[previous]);
      double Dot1 = Radial[previous] * Around[previous];
      double cwa = Math.Abs(Dot1 / Cross1.Length);

      Vector3d Cross2 = Vector3d.CrossProduct(Radial[next], Around[j]);
      double Dot2 = Radial[next] * Around[j];
      double cwb = Math.Abs(Dot2 / Cross2.Length);

      if(KPM.Halfedges[halfEdges[j]].AdjacentFace == -1){cwa = 0;}
      if(KPM.Halfedges[KPM.Halfedges.GetPairHalfedge(halfEdges[j])].AdjacentFace == -1){cwb = 0;}
      CotWeight[j] = cwa + cwb;
      WeightSum += CotWeight[j];
    }
    for (int j = 0; j < CotWeight.Length; j++) CotWeight[j] /= WeightSum;
    return CotWeight;
  }

  private static Curve[] CreateKnitContours(Mesh M, PolylineCurve SC, PolylineCurve EC, PolylineCurve LB, PolylineCurve RB, int Count)
  {
    // init lists for contours
    Curve[] contours = new Curve[Count + 2];

    // extract gradient from texture coordinates
    double[] values = new double[M.Vertices.Count];
    for(int i = 0;i < M.Vertices.Count;i++) values[i] = M.TextureCoordinates[i].Y;

    // get bounds of gradient value domain
    double min_val = values.Min();
    double max_val = values.Max();

    // compute stepsize for isa values
    double stepsize = (max_val - min_val) / (Count + 1.0);

    // create contours in parallel
    Parallel.For(0, Count,
      j => {
      // compute current iso value
      double iso = min_val + ((j + 1) * stepsize);

      // init list for geometry storage
      List<Curve> curves = new List<Curve>();

      // loop over all faces
      for(int i = 0;i < M.Faces.Count;i++)
      {
        int va = M.Faces[i].A;
        int vb = M.Faces[i].B;
        int vc = M.Faces[i].C;

        double a = M.TextureCoordinates[va].Y - iso;
        double b = M.TextureCoordinates[vb].Y - iso;
        double c = M.TextureCoordinates[vc].Y - iso;

        Point3d pa = M.Vertices.Point3dAt(va);
        Point3d pb = M.Vertices.Point3dAt(vb);
        Point3d pc = M.Vertices.Point3dAt(vc);

        List<Point3d> ends = new List<Point3d>();

        // find line segment
        if(a < 0 != b < 0)
        {
          double wa = b / (b - a);
          double wb = 1 - wa;
          ends.Add(wa * pa + wb * pb);
        }
        if(a < 0 != c < 0)
        {
          double wa = c / (c - a);
          double wc = 1 - wa;
          ends.Add(wa * pa + wc * pc);
        }
        if(c < 0 != b < 0)
        {
          double wb = c / (c - b);
          double wc = 1 - wb;
          ends.Add(wb * pb + wc * pc);
        }

        // if line segment is complete add it to list
        if(ends.Count == 2)
        {
          curves.Add(new Line(ends[0], ends[1]).ToNurbsCurve());
        }
      }

      // insert contour into array
      contours[j + 1] = Rhino.Geometry.Curve.JoinCurves(curves)[0];
      // end parallel for
      });

    // insert left and right boundary
    Array.Reverse(contours);
    contours[0] = LB;
    contours[Count + 1] = RB;

    // unify direction of contour curves
    for (int i = 0; i < contours.Count(); i++)
    {
      double scpt;
      SC.ClosestPoint(contours[i].PointAtStart, out scpt);
      Point3d scp = SC.PointAt(scpt);
      if (contours[i].PointAtStart.DistanceTo(scp) > Rhino.RhinoDoc.ActiveDoc.ModelAbsoluteTolerance) contours[i].Reverse();
    }
    return contours;
  }
# ---------- end hmkcom ----------
knitcontours_openpatch = Data(hmkcom.KnitContours)

# ----
# Switch between mesh patch
# and tubular mesh patch examples
use_tubular_input_mesh = BooleanToggle(False)
knitcontours_openpatch_2 = Data(knitcontours_openpatch)
knitmesh_openpatch_6 = Mesh(knitmesh_openpatch_5)
knitcontours_tubular_2 = Data(knitcontours_tubular)
knitmesh_tubular_4 = Mesh(knitmesh_tubular_3)
filter = StreamFilter(Gate=use_tubular_input_mesh, Stream0=knitmesh_openpatch_6, Stream1=knitmesh_tubular_4)
filter_2 = StreamFilter(Gate=use_tubular_input_mesh, Stream0=knitcontours_openpatch_2, Stream1=knitcontours_tubular_2)
referencegeometry = Mesh(filter)
knitcontours = Data(filter_2)

# ----
# Stitch dimensions
# BE CAREFUL!
# 
# Setting fine stitch dimensions like
# on huge meshes will either lead to
# loooong computation times or even
# software crashes.
# 
# A possible mitigation strategy is to
# manually patch the mesh into smaller
# sub-meshes first.
courseheight_c = Slider(0.00519, range=0..0.1)
stitchwidth_w = Slider(0.01098, range=0..0.1)
courseheight_c_2 = Number(courseheight_c)
stitchwidth_w_2 = Number(stitchwidth_w)

# ----
# Rendering of KnitContours
# to visualise knitting time
number_slider_2 = Slider(3, range=0..10)
knitcontours_2 = Data(knitcontours)
rkc = RenderKnitContours(KnitContours=knitcontours_2, Thickness=number_slider_2)  # inputs KnitContours: list of Curve, Thickness: Int32
# ---------- rkc: Python ----------
"""
Attempts to visualise the time flow on KnitContours by rendering them as
gradient coloured curves. Will work with any type of curve, actually.
    Inputs:
        KnitContours: Some KnitContours to visualise (works with any curve). 
                      {list, curve/polyline}
        Thickness: The thickness of the rendered curves.
                   Defaults to 3.
                   {item, int}
    Remarks:
        Author: Max Eschenbach
        License: MIT License
        Version: 210929
"""

# PYTHON STANDARD LIBRARY IMPORTS
from __future__ import division

# GHPYTHON SDK IMPORTS
from ghpythonlib.componentbase import executingcomponent as component
import Grasshopper, GhPython
import System
import Rhino
import rhinoscriptsyntax as rs

# ADDITIONAL RHINO IMPORTS
from scriptcontext import sticky as st

# GHENV COMPONENT SETTINGS
ghenv.Component.Name = "RenderKnitContours"
ghenv.Component.NickName ="RKC"
ghenv.Component.Category = "Cockatoo"
ghenv.Component.SubCategory = "08 Visualisation"

# LOCAL MODULE IMPORTS
try:
    from cockatoo.utilities import map_values_as_colors
except ImportError:
    errMsg = "The Cockatoo python module seems to be not correctly " + \
             "installed! Please make sure the module is in you search " + \
             "path, see README for instructions!."
    raise ImportError(errMsg)

class RenderKnitContours(component):
    
    def __init__(self):
        super(RenderKnitContours, self).__init__()
        
        self.drawing_curves = []
    
    def get_ClippingBox(self):
        return Rhino.Geometry.BoundingBox()
    
    def DrawViewportWires(self, args):
        try:
            # get the display from the arguments
            display = args.Display
            
            for curve in self.drawing_curves:
                display.DrawCurve(curve[0], curve[1], curve[2])
            
        except Exception, e:
            System.Windows.Forms.MessageBox.Show(str(e),
                                                 "Error while drawing preview!")
    
    def RunScript(self, KnitContours, Thickness):
        
        # VISUALISATION OF CONTOURS USING CUSTOM DISPLAY -----------------------
        
        # set default thickness
        if Thickness == None:
            Thickness = 3
        
        if KnitContours:
            
            drawing_curves = []
            
            # make customdisplay
            for i, pl in enumerate(KnitContours):
                if type(pl) == Rhino.Geometry.PolylineCurve and pl.Degree == 1:
                    polypts = []
                    for j in range(pl.PointCount):
                        cpt = pl.Point(j)
                        polypts.append(Rhino.Geometry.Point3d(cpt.X, 
                                                              cpt.Y,
                                                              cpt.Z))
                    pl = Rhino.Geometry.Polyline(polypts)
                    segs = [Rhino.Geometry.LineCurve(s) \
                            for s in pl.GetSegments()]
                    numseg = len(segs)
                    ccols = map_values_as_colors(range(numseg),
                                                 0,
                                                 numseg,
                                                 0.0,
                                                 0.35)
                    for j, seg in enumerate(segs):
                        drawing_curves.append((seg, ccols[j], Thickness))
                else:
                    abstol = Rhino.RhinoDoc.ActiveDoc.ModelAbsoluteTolerance
                    angletol = Rhino.RhinoDoc.ActiveDoc.ModelAngleToleranceRadians
                    minlen = abstol
                    maxlen = 100
                    # make polylinecurve (!)
                    pl = pl.ToPolyline(abstol, angletol, minlen, maxlen)
                    # make polyline
                    pl = pl.ToPolyline()
                    segs = [Rhino.Geometry.LineCurve(s) \
                            for s in pl.GetSegments()]
                    numseg = len(segs)
                    ccols = map_values_as_colors(range(numseg),
                                                 0,
                                                 numseg,
                                                 0.0,
                                                 0.35)
                    for j, seg in enumerate(segs):
                        drawing_curves.append((seg, ccols[j], Thickness))
            
            # set attributes for drawing routine
            self.drawing_curves = drawing_curves
            
        elif not KnitContours:
            self.drawing_curves = []
            rml = self.RuntimeMessageLevel.Warning
            rMsg = "No KnitContours input!"
            self.AddRuntimeMessage(rml, rMsg)
        else:
            self.drawing_curves = []
# ---------- end rkc ----------

# ----
# Toggle to generate
# knitting graph and pattern --->
toggle = BooleanToggle(True)

# ----
# Initialize KnitNetwork
referencegeometry_2 = Mesh(referencegeometry)
courseheight_c_3 = Number(courseheight_c_2)
knitcontours_3 = Data(knitcontours)
ikn = InitializeKnitNetwork(Toggle=toggle, KnitContours=knitcontours_3, CourseHeight=courseheight_c_3, ReferenceGeometry=referencegeometry_2)  # -> KnitNetwork; inputs Toggle: Boolean, KnitContours: list of Curve
# ---------- ikn: Python ----------
"""
Initialize a KnitNetwork from a set of KnitContours (i.e. isocurves / isolines)
and an optional reference geometry.
---
[NOTE] The ReferenceGeometry is a mesh or surface which is described by the network.
While it is optional, it is **HIGHLY** recommended to provide it, as downstream
methods like meshing or creating a dual might fail without it.
    Inputs:
        Toggle: Set to True to initialize the KnitNetwork.
                {item, bool}
        KnitContours: The contours of the knitting pattern.
                      {list, curve/polyline}
        CourseHeight: The course height of the knitting machine.
                      {item, float}
        ReferenceGeometry: The reference geometry this network is based on.
                           {item, mesh/surface)
    Output:
        KnitNetwork: The initialized KnitNetwork.
                     {item, KnitNetwork}
    Remarks:
        Author: Max Eschenbach
        License: MIT License
        Version: 200801
"""

# PYTHON STANDARD LIBRARY IMPORTS
from __future__ import division

# GPYTHON SDK IMPORTS
from ghpythonlib.componentbase import executingcomponent as component
import Grasshopper, GhPython
import System
import Rhino
import rhinoscriptsyntax as rs

# GHENV COMPONENT SETTINGS
ghenv.Component.Name = "InitializeKnitNetwork"
ghenv.Component.NickName ="IKN"
ghenv.Component.Category = "Cockatoo"
ghenv.Component.SubCategory = "06 KnitNetwork"

# LOCAL MODULE IMPORTS
try:
    import cockatoo
except ImportError:
    errMsg = "The Cockatoo python module seems to be not correctly " + \
             "installed! Please make sure the module is in you search " + \
             "path, see README for instructions!."
    raise ImportError(errMsg)

class InitializeKnitNetwork(component):
    
    def RunScript(self, Toggle, KnitContours, CourseHeight, ReferenceGeometry):
        
        if Toggle and KnitContours and CourseHeight:
            
            # sanitize reference geometry
            if not (isinstance(ReferenceGeometry, Rhino.Geometry.Surface)
            or isinstance(ReferenceGeometry, Rhino.Geometry.NurbsSurface)
            or isinstance(ReferenceGeometry, Rhino.Geometry.Mesh) 
            or isinstance(ReferenceGeometry, Rhino.Geometry.Brep)):
                errMsg = "Input ReferenceGeometry is not a valid Mesh, " + \
                         "Surface or Brep! 'reference_geometry' attribute " + \
                         "will not be set!"
                rml = self.RuntimeMessageLevel.Warning
                self.AddRuntimeMessage(rml, errMsg)
                ReferenceGeometry = None
            
            # create KnitNetwork (inherits from nx.Graph)
            KN = cockatoo.KnitNetwork.create_from_contours(KnitContours,
                                                           CourseHeight,
                                                           ReferenceGeometry)
        elif Toggle and not KnitContours:
            rml = self.RuntimeMessageLevel.Warning
            rMsg = "No KnitContours input!"
            self.AddRuntimeMessage(rml, rMsg)
            return Grasshopper.DataTree[object]()
        elif Toggle and not CourseHeight:
            rml = self.RuntimeMessageLevel.Warning
            rMsg = "No CourseHeight input!"
            self.AddRuntimeMessage(rml, rMsg)
            return Grasshopper.DataTree[object]()
        else:
            return Grasshopper.DataTree[object]()
        
        # return outputs if you have them; here I try it for you:
        return KN
# ---------- end ikn ----------
knitnetwork = Data(ikn)

# ----
# Initialize weft and warp edges
number_slider_3 = Slider(-1, range=-1..50)
propagatefromcenter = BooleanToggle(False)
continuousstart = BooleanToggle(False)
continuousend = BooleanToggle(False)
precise = BooleanToggle(False)
knitnetwork_2 = Data(knitnetwork)
iwawe = InitializeWeftAndWarpEdges(
    Toggle=Toggle(True),
    KnitNetwork=knitnetwork_2,
    SplittingIndex=number_slider_3,
    ContinuousStart=continuousstart,
    ContinuousEnd=continuousend,
    PropagateFromCenter=propagatefromcenter,
    Precise=precise)  # -> KnitNetwork; inputs Toggle: Boolean, SplittingIndex: Int32, ContinuousStart: Boolean, ContinuousEnd: Boolean, PropagateFromCenter: Boolean, Precise: Boolean
# ---------- iwawe: Python ----------
"""
Initialize preliminary 'weft' connections (edges) and first 'warp' connections
(edges) for a given KnitNetwork.
---
[WARNING] The implementation used is research-level code and not optimized. This
can lead to substantial computation time, depending on size of the mesh, stitch
parameters and hardware of the machine!
    Inputs:
        Toggle: Set to True to activate the component.
                {item, bool}
        KnitNetwork: An initialized KnitNetwork.
                     {item, KnitNetwork}
        SplittingIndex: Optional splitting index for splitting the contours into
                        two sets (left and right). If no value or -1 is
                        supplied, the longest contour will be used.
                        {item, integer}
        ContinuousStart: If True, forces the first row of stitches to be
                         continuous.
                         Defaults to False.
                         {item, bool}
        ContinuousEnd: If True, forces the last row of stitchtes to be
                       continuous.
                       Defaults to False.
                       {item, bool}
        PropagateFromCenter: If True, will propagate left and right set of 
                             contours from the center contour defined by
                             SplittingIndex ( < | > ). Otherwise, the
                             propagation of the contours left to the center will
                             start at the left boundary ( > | > ).
                             Defaults to False.
                             {item, bool}
        Precise: If True, the more precise but slower DistanceTo() function will
                 be used instead of DistanceToSquared().
                 Defaults to False.
                 {item, bool}
    Output:
        KnitNetwork: The KnitNetwork with preliminary 'weft' and 'warp' edges 
                     created.
                     {item, KnitNetwork}
    Remarks:
        Author: Max Eschenbach
        License: MIT License
        Version: 200705
"""

# PYTHON STANDARD LIBRARY IMPORTS
from __future__ import division

# GPYTHON SDK IMPORTS
from ghpythonlib.componentbase import executingcomponent as component
import Grasshopper, GhPython
import System
import Rhino
import rhinoscriptsyntax as rs

# GHENV COMPONENT SETTINGS
ghenv.Component.Name = "InitializeWeftAndWarpEdges"
ghenv.Component.NickName ="IWAWE"
ghenv.Component.Category = "Cockatoo"
ghenv.Component.SubCategory = "06 KnitNetwork"

# LOCAL MODULE IMPORTS
try:
    import cockatoo
except ImportError:
    errMsg = "The Cockatoo python module seems to be not correctly " + \
             "installed! Please make sure the module is in you search " + \
             "path, see README for instructions!."
    raise ImportError(errMsg)

class InitializeWeftAndWarpEdges(component):
    
    def RunScript(self, Toggle, KN, SplittingIndex=None, ContinuousStart=False, ContinuousEnd=False, PropagateFromCenter=False, Precise=False):
        
        if Toggle and KN:
            # copy the input network to not mess with previous components
            KN = cockatoo.KnitNetwork(KN)
            
            if SplittingIndex < 0:
                SplittingIndex = None
            
            # initialize 'weft' edges between 'leaf' nodes
            KN.initialize_leaf_connections()
            
            # create preliminary 'weft' connections on the copy of the network
            KN.initialize_weft_edges(start_index=SplittingIndex,
                                     propagate_from_center=PropagateFromCenter,
                                     force_continuous_start=ContinuousStart,
                                     force_continuous_end=ContinuousEnd,
                                     max_connections=4,
                                     least_connected=False,
                                     precise=Precise,
                                     verbose=False)
            
            # initialize first 'warp' connections
            KN.initialize_warp_edges(contour_set=None,
                                     verbose=False)
            
        elif not Toggle and KN:
            return Grasshopper.DataTree[object]()
        elif not KN:
            rml = self.RuntimeMessageLevel.Warning
            rMsg = "No KnitNetwork input!"
            self.AddRuntimeMessage(rml, rMsg)
            return Grasshopper.DataTree[object]()
        else:
            return Grasshopper.DataTree[object]()
        
        return KN
# ---------- end iwawe ----------
knitnetwork_3 = Data(iwawe)

# ----
# Build mapping network
# (mapping network is attached
# to the KnitNetwork but also
# put out as a seperate instance)
toggle_2 = BooleanToggle(True)
knitnetwork_4 = Data(knitnetwork_3)
bmn = BuildMappingNetwork(Toggle=toggle_2, KnitNetwork=knitnetwork_4)  # -> KnitNetwork, KnitMappingNetwork; inputs Toggle: Boolean
# ---------- bmn: Python ----------
"""
Assign 'segment' attributes to nodes and 'weft' edges based on their position
between two 'end' nodes and build a mapping network used for final loop
generation.
    Inputs:
        Toggle: Set to true to activate
                {item, bool}
        KnitNetwork: An initialized KnitNetwork with preliminary 'weft' and
                     first 'warp' connections (edges).
                     {item, KnitNetwork}
    Output:
        KnitNetwork: The KnitNetwork, consisting only of 'warp' edges and their
                     'end' nodes but with an embedded MappingNetwork for final
                     loop generation.
                     {item, KnitNetwork}
        KnitMappingNetwork: Only the mapping network of the KnitNetwork.
                            NOTE The mapping network is also embedded in the
                            KnitNetwork during this step and can be accessed by
                            the KnitNetwork.MappingNetwork property. It is
                            returned here as a seperate output for reasons of
                            visualisation, analysis and troubleshooting.
                            {item, KnitMappingNetwork}
    Remarks:
        Author: Max Eschenbach
        License: MIT License
        Version: 200717
"""

# GPYTHON SDK IMPORTS
from ghpythonlib.componentbase import executingcomponent as component
import Grasshopper, GhPython
import System
import Rhino
import rhinoscriptsyntax as rs

# GHENV COMPONENT SETTINGS
ghenv.Component.Name = "BuildMappingNetwork"
ghenv.Component.NickName ="BMN"
ghenv.Component.Category = "Cockatoo"
ghenv.Component.SubCategory = "06 KnitNetwork"

# LOCAL MODULE IMPORTS
try:
    import cockatoo
except ImportError:
    errMsg = "The Cockatoo python module seems to be not correctly " + \
             "installed! Please make sure the module is in you search " + \
             "path, see README for instructions!."
    raise ImportError(errMsg)

class BuildMappingNetwork(component):
    
    def RunScript(self, Toggle, KN):
        
        if Toggle and KN:
            # copy the input network to not mess with previous components
            KN = cockatoo.KnitNetwork(KN)
            
            # CREATE SEGMENTATION AND ASSIGN ATTRIBUTES ------------------------
            
            KN.assign_segment_attributes()
            
            # CHECK THE RESULTS ------------------------------------------------
            
            for edge in KN.edges(data=True):
                s = edge[2]["segment"]
                w = edge[2]["weft"]
                if w and not s:
                    vStr = "'weft' edge {} has no segment value!"
                    vStr = vStr.format((edge[0], edge[1]))
                    rml = self.RuntimeMessageLevel.Warning
                    self.AddRuntimeMessage(rml, vStr)
            
            for node in KN.nodes(data=True):
                e = node[1]["end"]
                s = node[1]["segment"]
                if not s:
                    if not e:
                        vStr = "node {} has no segment value!"
                        vStr = vStr.format(node[0])
                        rml = self.RuntimeMessageLevel.Warning
                        self.AddRuntimeMessage(rml, vStr)
            # CREATE MAPPING NETWORK -------------------------------------------
            
            KN.create_mapping_network()
            MappingNetwork = KN.mapping_network
            
        elif not Toggle and KN:
            return KN, Grasshopper.DataTree[object]()
        elif Toggle and not KN:
            rml = self.RuntimeMessageLevel.Warning
            self.AddRuntimeMessage(rml, "No KnitNetwork input!")
            return Grasshopper.DataTree[object](), Grasshopper.DataTree[object]()
        elif not Toggle and not KN:
            return Grasshopper.DataTree[object](), Grasshopper.DataTree[object]()
        
        # return outputs if you have them; here I try it for you:
        return KN, MappingNetwork
# ---------- end bmn ----------
knitmappingnetwork = Data(bmn.KnitMappingNetwork)
knitnetwork_5 = Data(bmn.KnitNetwork)

# ----
# Sample weft edges and
# create final warp edges
toggle_3 = BooleanToggle(True)
includeends = BooleanToggle(True)
precise_2 = BooleanToggle(False)
stitchwidth_w_3 = Number(stitchwidth_w_2)
knitnetwork_6 = Data(knitnetwork_5)
cfnt = CreateFinalNetworkTopology(Toggle=toggle_3, KnitNetwork=knitnetwork_6, StitchWidth=stitchwidth_w_3, IncludeEnds=includeends, Precise=precise_2)  # -> KnitNetwork; inputs Toggle: Boolean, IncludeEnds: Boolean, Precise: Boolean
# ---------- cfnt: Python ----------
"""
Create the final network topology by using the previosly created and embedded
mapping network to sample the courses with the stitch width. Subsequently, all
final 'weft' and 'warp' edges will be created.
---
[WARNING] The implementation used is research-level code and not optimized. This
can lead to substantial computation time, depending on size of the mesh, stitch
parameters and hardware of the machine!
    Inputs:
        Toggle: Set to true to activate the component.
                {item, boolean}
        KnitNetwork: A KnitNetwork with a previosly created, embedded mapping
                     network.
                     {item, KnitNetwork}
        IncludeEnds: If True, 'end' nodes between adjacent segments in a source
                     chain will be included in the first pass of connecting
                     'warp' edges.
                     Defaults to True.
                     {item, bool}
        Precise: If True, the more precise but slower DistanceTo() function will
                 be used instead of DistanceToSquared().
                 Defaults to False.
                 {item, boolean}
    Output:
        KnitNetwork: The KnitNetwork representing the final knit topology with
                     stitches, increases, decreases and short rows.
                     {item, KnitNetwork}
    Remarks:
        Author: Max Eschenbach
        License: MIT License
        Version: 200705
"""

# PYTHON STANDARD LIBRARY IMPORTS
from __future__ import division

# GPYTHON SDK IMPORTS
from ghpythonlib.componentbase import executingcomponent as component
import Grasshopper, GhPython
import System
import Rhino
import rhinoscriptsyntax as rs

# GHENV COMPONENT SETTINGS
ghenv.Component.Name = "CreateFinalNetworkTopology"
ghenv.Component.NickName ="CFNT"
ghenv.Component.Category = "Cockatoo"
ghenv.Component.SubCategory = "06 KnitNetwork"

# LOCAL MODULE IMPORTS
try:
    import cockatoo
except ImportError:
    errMsg = "The Cockatoo python module seems to be not correctly " + \
             "installed! Please make sure the module is in you search " + \
             "path, see README for instructions!."
    raise ImportError(errMsg)

class CreateFinalNetworkTopology(component):
    
    def RunScript(self, Toggle, KN, StitchWidth, IncludeEnds=True, Precise=False):
        
        if Toggle and KN and StitchWidth:
            KN = cockatoo.KnitNetwork(KN)
            
            # SAMPLING OF SEGMENT CONTOURS -------------------------------------
            
            KN.sample_segment_contours(StitchWidth)
            
            # CREATION OF FINAL WEFT CONNECTIONS -------------------------------
            
            KN.create_final_weft_connections()
            
            # CREATION OF WARP CONNECTIONS -------------------------------------
            
            KN.create_final_warp_connections(max_connections=4,
                                             include_end_nodes=IncludeEnds,
                                             precise=Precise,
                                             verbose=False)
        else:
            if not KN:
                rml = self.RuntimeMessageLevel.Warning
                self.AddRuntimeMessage(rml, "No KnitNetwork input!")
            if not StitchWidth:
                rml = self.RuntimeMessageLevel.Warning
                self.AddRuntimeMessage(rml, "No StitchWidth input!")
            KN = Grasshopper.DataTree[object]()
        
        # return outputs if you have them; here I try it for you:
        return KN
# ---------- end cfnt ----------
knitnetwork_7 = Data(cfnt)
panel = Panel(knitnetwork_7)

# ----
# Compute statistics
# about the KnitNetwork
courseheight_c_4 = Number(courseheight_c_2)
stitchwidth_w_4 = Number(stitchwidth_w_2)
knitnetwork_8 = Data(knitnetwork_7)
kns = KnitNetworkStatistics(KnitNetwork=knitnetwork_8, CourseHeight=courseheight_c_4, StitchWidth=stitchwidth_w_4)  # -> SummaryText, EdgeDeviation, EdgeDeviationFactor, MinDeviation, MaxDeviation, AverageDeviation, Variance, StandardDeviation
# ---------- kns: Python ----------
"""
Provides some statistical data for a KnitNetwork. Used to check how closely
the edges of the KnitNetwork match a given CourseHeight and StitchWidth.
    Inputs:
        KnitNetwork: A KnitNetwork for analysis of edge lengths.
                     {item, KnitNetwork}
        CourseHeight: CourseHeight for comparison.
                      {item, float}
        StitchWidth: StitchWidth for comparison.
                     {item, float}
    Output:
        SummaryText: A textual summary of the statistical data.
                     NOTE: Values are rounded and always displayed in
                     millimeters, regardless of model unit settings!
                     {item, Text}
        EdgeDeviation: Signed length deviation for all edges of the KnitNetwork
                       in model units.
                       {list, float}
        EdgeDeviationFactor: Signed length deviation factor for all edges of the
                             KnitNetwork.
                             {list, float}
        MinDeviation: Absolute minimum deviation in model units.
                      {item, float}
        MaxDeviation: Absolute maximum deviation in model units.
                      {item, float}
        AverageDeviation: Absolute average deviation in model units.
                          {item, float}
        Variance: Absolute variance in model units.
                  {item, float}
        StandardDeviation: Absolute standard deviation in model units.
                           {item, float}
    Remarks:
        Author: Max Eschenbach
        License: MIT License
        Version: 200719
"""

# PYTHON STANDARD LIBRARY IMPORTS
from __future__ import division
from __future__ import print_function
import math

# GHPYTHON SDK IMPORTS
from ghpythonlib.componentbase import executingcomponent as component
import Grasshopper, GhPython
import System
import Rhino
import rhinoscriptsyntax as rs

# GHENV COMPONENT SETTINGS
ghenv.Component.Name = "KnitNetworkStatistics"
ghenv.Component.NickName ="KNS"
ghenv.Component.Category = "Cockatoo"
ghenv.Component.SubCategory = "06 KnitNetwork"

# LOCAL MODULE IMPORTS
try:
    import cockatoo
except ImportError:
    errMsg = "The Cockatoo python module seems to be not correctly " + \
             "installed! Please make sure the module is in you search " + \
             "path, see README for instructions!."
    raise ImportError(errMsg)

class KnitNetworkStatistics(component):
    
    def RunScript(self, KnitNetwork, CourseHeight, StitchWidth):
        
        EdgeDeviation = []
        EdgeDeviationFactor = []
        AbsoluteDeviation = []
        AbsoluteDeviationFactor = []
        
        if not KnitNetwork:
            rml = self.RuntimeMessageLevel.Warning
            self.AddRuntimeMessage(rml,
                                   "No KnitNetwork input!")
            return (Grasshopper.DataTree[object](),
                    Grasshopper.DataTree[object](),
                    Grasshopper.DataTree[object](),
                    Grasshopper.DataTree[object](),
                    Grasshopper.DataTree[object](),
                    Grasshopper.DataTree[object](),
                    Grasshopper.DataTree[object](),
                    Grasshopper.DataTree[object]())
        
        for i, edge in enumerate(KnitNetwork.edges_iter(data=True)):
            edgedata = edge[2]
            if edgedata["warp"]:
                el = edgedata["geo"].Length
                # compute real deviation
                dev = el - CourseHeight
                EdgeDeviation.append(dev)
                AbsoluteDeviation.append(abs(dev))
                # compute percentage
                devperc = dev / CourseHeight
                EdgeDeviationFactor.append(devperc)
                AbsoluteDeviationFactor.append(abs(devperc))
            elif edgedata["weft"]:
                el = edgedata["geo"].Length
                # compute real deviation
                dev = el - StitchWidth
                EdgeDeviation.append(dev)
                AbsoluteDeviation.append(abs(dev))
                # compute percentage
                devperc = dev / StitchWidth
                EdgeDeviationFactor.append(devperc)
                AbsoluteDeviationFactor.append(abs(devperc))
        
        # compute number of edges from deviation list
        numedges = len(EdgeDeviation)
        
        if numedges == 0:
            rml = self.RuntimeMessageLevel.Warning
            self.AddRuntimeMessage(rml,
                                   "Input KnitNetwork has no edges!")
            return (Grasshopper.DataTree[object](),
                    Grasshopper.DataTree[object](),
                    Grasshopper.DataTree[object](),
                    Grasshopper.DataTree[object](),
                    Grasshopper.DataTree[object](),
                    Grasshopper.DataTree[object](),
                    Grasshopper.DataTree[object](),
                    Grasshopper.DataTree[object]())
        
        # compute +- 1 % deviation amount
        pm_one = [d for d in EdgeDeviationFactor if d > -0.01 and d <= 0.01]
        pm_one_perc = round((len(pm_one) / numedges) * 100, 2)
        
        # compute +- 5 % deviation amount
        pm_ofive = [d for d in EdgeDeviationFactor if d >= -0.05 and d <= 0.05]
        pm_ofive_perc = round((len(pm_ofive) / numedges) * 100, 2)
        
        # compute +- 10 % deviation amount
        pm_ten = [d for d in EdgeDeviationFactor if d >= -0.1 and d <= 0.1]
        pm_ten_perc = round((len(pm_ten) / numedges) * 100, 2)
        
        # compute +- 20 % deviation amount
        pm_twen = [d for d in EdgeDeviationFactor if d >= -0.2 and d <= 0.2]
        pm_twen_perc = round((len(pm_twen) / numedges) * 100, 2)
        
        # compute +- 30 % deviation amount
        pm_thir = [d for d in EdgeDeviationFactor if d >= -0.3 and d <= 0.3]
        pm_thir_perc = round((len(pm_thir) / numedges) * 100, 2)
        
        # compute +- 40 % deviation amount
        pm_four = [d for d in EdgeDeviationFactor if d >= -0.4 and d <= 0.4]
        pm_four_perc = round((len(pm_four) / numedges) * 100, 2)
        
        # compute +- 50 % deviation amount
        pm_five = [d for d in EdgeDeviationFactor if d >= -0.5 and d <= 0.5]
        pm_five_perc = round((len(pm_five) / numedges) * 100, 2)
        
        # compute +- 60 % deviation amount
        pm_six = [d for d in EdgeDeviationFactor if d >= -0.6 and d <= 0.6]
        pm_six_perc = round((len(pm_six) / numedges) * 100, 2)
        
        # compute +- 70 % deviation amount
        pm_seven = [d for d in EdgeDeviationFactor if d >= -0.7 and d <= 0.7]
        pm_seven_perc = round((len(pm_seven) / numedges) * 100, 2)
        
        # compute +- 80 % deviation amount
        pm_eight = [d for d in EdgeDeviationFactor if d >= -0.8 and d <= 0.8]
        pm_eight_perc = round((len(pm_eight) / numedges) * 100, 2)
        
        # compute +- 90 % deviation amount
        pm_nine = [d for d in EdgeDeviationFactor if d >= -0.9 and d <= 0.9]
        pm_nine_perc = round((len(pm_nine) / numedges) * 100, 2)
        
        # compute +- 100 % deviation amount
        pm_hund = [d for d in EdgeDeviationFactor if d >= -1 and d <= 1]
        pm_hund_perc = round((len(pm_hund) / numedges) * 100, 2)
        
        # compute average, variance and standard deviation
        AverageDeviation = (sum(AbsoluteDeviation)
                             / len(AbsoluteDeviation))
        Variance = (sum([((ed - AverageDeviation) ** 2)
                         for ed in AbsoluteDeviation])
                    / len(AbsoluteDeviation))
        StandardDeviation = math.sqrt(Variance)
        
        # compute percentages
        AveragePercentage = (sum(AbsoluteDeviationFactor)
                             / len(AbsoluteDeviationFactor))
        VariancePercentage = (sum([((ed - AveragePercentage) ** 2)
                                   for ed in AbsoluteDeviationFactor])
                              / len(AbsoluteDeviationFactor))
        StandardPercentage = math.sqrt(VariancePercentage)
        
        # convert deviations to millimeters for readability
        musys = Rhino.RhinoDoc.ActiveDoc.ModelUnitSystem
        modelscale = Rhino.RhinoMath.UnitScale(musys,
                                               Rhino.UnitSystem.Millimeters)
        avg_mm = AverageDeviation * modelscale
        var_mm = Variance * modelscale
        sdev_mm = StandardDeviation * modelscale
        
        # compute minimum and maximum deviation
        MinDeviation = min(AbsoluteDeviation)
        MinPercentage = min(AbsoluteDeviationFactor)
        MaxDeviation = max(AbsoluteDeviation)
        MaxPercentage = max(AbsoluteDeviationFactor)
        
        # compile textual summary
        Summary = []
        txtsum_string = "{} edges ({} %) are within +- {} % deviation."
        Summary.append("KnitNetwork contains {} edges.".format(numedges))
        Summary.append(txtsum_string.format(len(pm_one), pm_one_perc, "1"))
        Summary.append(txtsum_string.format(len(pm_ofive), pm_ofive_perc, "5"))
        Summary.append(txtsum_string.format(len(pm_ten), pm_ten_perc, "10"))
        Summary.append(txtsum_string.format(len(pm_twen), pm_twen_perc, "20"))
        Summary.append(txtsum_string.format(len(pm_thir), pm_thir_perc, "30"))
        Summary.append(txtsum_string.format(len(pm_four), pm_four_perc, "40"))
        Summary.append(txtsum_string.format(len(pm_five), pm_five_perc, "50"))
        Summary.append(txtsum_string.format(len(pm_six), pm_six_perc, "60"))
        Summary.append(txtsum_string.format(len(pm_seven), pm_seven_perc, "70"))
        Summary.append(txtsum_string.format(len(pm_eight), pm_eight_perc, "80"))
        Summary.append(txtsum_string.format(len(pm_nine), pm_nine_perc, "90"))
        Summary.append(txtsum_string.format(len(pm_hund), pm_hund_perc, "100"))
        
        Summary.append(
            "The minimum deviation is {} millimeters ({} %)".format(
                                            round(MinDeviation * modelscale, 2),
                                            round(MinPercentage * 100, 2)))
                                                    
        Summary.append(
            "The maximum deviation is {} millimeters ({} %)".format(
                                            round(MaxDeviation * modelscale, 2),
                                            round(MaxPercentage * 100, 2)))
        Summary.append(
            "The average deviation is {} millimeters ({} %)".format(
                                            round(avg_mm, 2),
                                            round(AveragePercentage * 100, 2)))
        Summary.append(
            "The variance is {} millimeters ({} %)".format(
                                            round(var_mm, 2),
                                            round(VariancePercentage * 100, 2)))
        Summary.append(
            "The standard deviation is {} millimeters ({} %)".format(
                                            round(sdev_mm, 2),
                                            round(StandardPercentage * 100, 2)))
        
        # return outputs if you have them; here I try it for you:
        return (Summary,
                EdgeDeviation,
                EdgeDeviationFactor,
                MinDeviation,
                MaxDeviation,
                AverageDeviation,
                Variance,
                StandardDeviation)
# ---------- end kns ----------
summary_of_knitnetwork_statistics = Panel(kns.SummaryText)

# ----
# Select nodes and assign color
# (to encode different yarns or stitch types)
referencegeometry_3 = Mesh(referencegeometry_2)
medges_2 = MeshEdges(Mesh=referencegeometry_3)  # -> NakedEdges, InteriorEdges, NonManifoldEdges
knitnetwork_9 = Data(knitnetwork_7)
join_3 = JoinCurves(Curves=medges_2.NakedEdges, Preserve=False)
knitnetwork_10 = Data(knitnetwork_9)
nbcp = NodesByCurveProximity(KnitNetwork=knitnetwork_10, SampleCurves=join_3, Tolerance=Slider(0.02, range=0..1))  # -> NodeIndices, Nodes, NodePoints; inputs SampleCurves: list of Curve
# ---------- nbcp: Python ----------
"""
Select KnitNetwork Nodes by proximity by selecting all nodes that are closer
than the specified Tolerance to the given SamplePoints.
    Inputs:
        KnitNetwork: The KnitNetwork to select nodes from.
                     {item, KnitNetworkBase}
        SampleCurves: Curve for proximity search.
                      {list, point3d}
        Tolerance: All nodes closer to the sample curves than this value will
                   be selected by the component.
                   Defaults to [0.01] units.
                   {item, float}
    Outputs:
        NodeIndices: The indices (identifiers) of the found nodes within the
                     network.
                     {list, int}
        Nodes: The found nodes as node-2-tuples consisting of (index, data).
               {list, nodes}
        NodePoints: The Point3d geometry of the selected nodes within the
                    network.
                    {list, point3d}
    Remarks:
        Author: Max Eschenbach
        License: MIT License
        Version: 200705
"""

# PYTHON STANDARD LIBRARY IMPORTS
from __future__ import division

# GHPYTHON SDK IMPORTS
from ghpythonlib.componentbase import executingcomponent as component
import Grasshopper, GhPython
import System
import Rhino
import rhinoscriptsyntax as rs

# GHENV COMPONENT SETTINGS
ghenv.Component.Name = "NodesByCurveProximity"
ghenv.Component.NickName ="NBCP"
ghenv.Component.Category = "Cockatoo"
ghenv.Component.SubCategory = "07 KnitNetwork Editing"

# LOCAL MODULE IMPORTS
try:
    import cockatoo
except ImportError:
    errMsg = "The Cockatoo python module seems to be not correctly " + \
             "installed! Please make sure the module is in you search " + \
             "path, see README for instructions!."
    raise ImportError(errMsg)

class NodesByCurveProximity(component):
    
    def __init__(self):
        super(NodesByCurveProximity, self).__init__()
        
        self.drawing_nodes = []
        self.skip_invalid = False
    
    def is_point_within_tolerance_to_crv(self, data_tuple):
        node, sample_crvs, tol = data_tuple
        for j, samplecrv in enumerate(sample_crvs):
            if samplecrv == None:
                continue
            curve_cp = samplecrv.ClosestPoint(node[1]["geo"], tol)
            if curve_cp[0]:
                return True
        return False
    
    def RunScript(self, KnitNetwork, SampleCurves, Tolerance=0.01):
        
        # set defaults and catch None values
        if Tolerance == None:
            Tolerance = 0.01
        
        # initialize outputs
        NodeIndices = Grasshopper.DataTree[object]()
        Nodes = Grasshopper.DataTree[object]()
        NodePoints = Grasshopper.DataTree[object]()
        
        # filter nodes according to input
        if KnitNetwork and SampleCurves:
            
            # get all the nodes of the network
            network_nodes = KnitNetwork.nodes(data=True)
            
            data_list = []
            for i, node in enumerate(network_nodes):
                data_tuple = (node, SampleCurves, Tolerance)
                data_list.append(data_tuple)
            
            results = GhPython.ScriptHelpers.Parallel.Run(
                                self.is_point_within_tolerance_to_crv,
                                data_list,
                                False)
            
            Nodes = [network_nodes[i] for i, val in enumerate(results) if val]
            NodeIndices = [n[0] for n in Nodes]
            NodePoints = [n[1]["geo"] for n in Nodes]
        
        # catch missing inputs
        if not KnitNetwork:
            errMsg = "No KnitNetwork input!"
            rml = self.RuntimeMessageLevel.Warning
            self.AddRuntimeMessage(rml, errMsg)
        if not SampleCurves:
            errMsg = "No SampleCurves input!"
            rml = self.RuntimeMessageLevel.Warning
            self.AddRuntimeMessage(rml, errMsg)
        
        # return results
        return NodeIndices, Nodes, NodePoints
# ---------- end nbcp ----------
color = ColourSwatch(SwatchColor=RGB(157, 0, 255))
knitnetwork_11 = Data(knitnetwork_9)
nodeindex = Data(nbcp.NodeIndices)
select_nodes_and_colorize = BooleanToggle(True)
snc = SetNodeColor(KnitNetwork=knitnetwork_11, NodeIndex=nodeindex, Color=color)  # -> KnitNetwork; inputs NodeIndex: list of Int32, Color: Color
# ---------- snc: Python ----------
"""
Set a specific color to nodes selected by indices in the network.
    Inputs:
        KnitNetwork: The KnitNetwork to edit nodes from.
                     {item, KnitNetworkBase}
        NodeIndex: Indices of the Nodes to assign color to.
                   {list, int}
        Color: New color for the specified nodes. This can also be None to reset
               the color of the nodes.
               {item, System.Drawing.Color}
    Outputs:
        KnitNetwork: The network with the new color information.
                     {tree, KnitNetworkBase}
    Remarks:
        Author: Max Eschenbach
        License: MIT License
        Version: 200705
"""

# PYTHON STANDARD LIBRARY IMPORTS
from __future__ import division

# GHPYTHON SDK IMPORTS
from ghpythonlib.componentbase import executingcomponent as component
import Grasshopper, GhPython
import System
import Rhino
import rhinoscriptsyntax as rs

# GHENV COMPONENT SETTINGS
ghenv.Component.Name = "SetNodeColor"
ghenv.Component.NickName ="SNC"
ghenv.Component.Category = "Cockatoo"
ghenv.Component.SubCategory = "07 KnitNetwork Editing"

# LOCAL MODULE IMPORTS
try:
    import cockatoo
except ImportError:
    errMsg = "The Cockatoo python module seems to be not correctly " + \
             "installed! Please make sure the module is in you search " + \
             "path, see README for instructions!."
    raise ImportError(errMsg)

class SetNodeColor(component):
    
    def __init__(self):
        super(SetNodeColor, self).__init__()
        
        self.drawing_nodes = []
        self.skip_invalid = False
    
    def RunScript(self, KnitNetwork, NodeIndex, Color):
        
        # initialize output so it's never empty
        KN = Grasshopper.DataTree[object]()
        
        # filter nodes according to input
        if KnitNetwork and NodeIndex:
            
            # make copy of the input to avoid messing up the data struture
            if isinstance(KnitNetwork, cockatoo.KnitNetwork):
                KN = cockatoo.KnitNetwork(KnitNetwork)
            elif isinstance(KnitNetwork, cockatoo.KnitMappingNetwork):
                KN = cockatoo.KnitMappingNetwork(KnitNetwork)
            elif isinstance(KnitNetwork, cockatoo.KnitDiNetwork):
                KN = cockatoo.KnitDiNetwork(KnitNetwork)
            
            for i in NodeIndex:
                if KN.has_node(i):
                    if Color != None:
                        KN.node[i]["color"] = (Color.R,
                                               Color.G,
                                               Color.B)
                    else:
                        KN.node[i]["color"] = None
            
            return KN
        
        # catch missing inputs
        if not KnitNetwork:
            errMsg = "No KnitNetwork input!"
            rml = self.RuntimeMessageLevel.Warning
            self.AddRuntimeMessage(rml, errMsg)
        if not NodeIndex:
            errMsg = "No NodeIndex input!"
            rml = self.RuntimeMessageLevel.Warning
            self.AddRuntimeMessage(rml, errMsg)
# ---------- end snc ----------
filter_3 = StreamFilter(Gate=select_nodes_and_colorize, Stream0=knitnetwork_7, Stream1=snc)

# ----
# Create native rhino mesh
# based on knitting topology
cyclesmode = ValueList({"World XY Plane": -1, "Node Normal Plane": 0, "Average Normal Plane": 1, "Average Fit/Normal Plane": 2}, selected="Average Normal Plane")
knitnetwork_12 = Data(knitnetwork_7)
cmfkn = CreateMeshFromKnitNetwork(Toggle=Toggle(False), KnitNetwork=knitnetwork_12, CyclesMode=cyclesmode)  # -> Mesh; inputs CyclesMode: Int32
# ---------- cmfkn: Python ----------
"""
Create a mesh from a KnitNetwork by finding the cycles (faces) of the
network.
---
[NOTE] This algorithm relies on finding cycles (quads and triangles) for the
supplied network. This is not a trivial task in 3d space - at least to my
knowledge. Assigning a geometrybase to the KnitNetwork on initialization
and choosing cyclesmode 1 or 2 greatly improves reliability!
None the less, success is very dependent on the curvature of the original
surface or mesh used.
---
[IMPLEMENTATION DETAIL] N-Gons are deliberately deactivated but can be activated
when editing the function call inside the scripting component and increasing
the max_valence value.
    Inputs:
        Toggle: Set to True to activate the component.
                {item, boolean}
        KnitNetwork: The KnitNetwork to create the mesh from.
                     {item, KnitNetwork}
        CyclesMode: Determines how the neighbors of each node are sorted when
                    finding the cycles of the network.
                    [-1] equals to using the World XY plane
                    [0] equals to using a plane normal to the origin nodes 
                        closest point on the geometrybase
                    [1] equals to using a plane normal to the average of the 
                        origin and neighbor nodes' closest points on the
                        geometrybase
                    [2] equals to using an average plane between a plane fit to 
                        the origin and its neighbor nodes and a plane normal to 
                        the origin nodes closest point on the geometrybase.
                    Defaults to -1.
                    {item, int}
    Outputs:
        Mesh: The Rhino mesh. {item, mesh}
    Remarks:
        Author: Max Eschenbach
        License: MIT License
        Version: 200705
"""

# PYTHON STANDARD LIBRARY IMPORTS
from __future__ import division

# GHPYTHON SDK IMPORTS
from ghpythonlib.componentbase import executingcomponent as component
import Grasshopper, GhPython
import System
import Rhino
import rhinoscriptsyntax as rs

# GHENV COMPONENT SETTINGS
ghenv.Component.Name = "CreateMeshFromKnitNetwork"
ghenv.Component.NickName ="CMFKN"
ghenv.Component.Category = "Cockatoo"
ghenv.Component.SubCategory = "06 KnitNetwork"

# LOCAL MODULE IMPORTS
try:
    from cockatoo import KnitNetwork
    from cockatoo import KnitDiNetwork
except ImportError:
    errMsg = "The Cockatoo python module seems to be not correctly " + \
             "installed! Please make sure the module is in you search " + \
             "path, see README for instructions!."
    raise ImportError(errMsg)

class CreateMeshFromKnitNetwork(component):
    
    def RunScript(self, Toggle, KN, CyclesMode):
        
        # sanitize inputs
        if CyclesMode == None:
            CyclesMode = -1
        elif CyclesMode < 0:
            CyclesMode = -1
        elif CyclesMode > 2:
            CyclesMode = 2
        
        # initialize Mesh
        Mesh = Grasshopper.DataTree[Rhino.Geometry.Mesh]()
        
        if Toggle and KN:
            if CyclesMode != -1 and not KN.graph["reference_geometry"]:
                errMsg = "KnitNetwork has no reference geometry " + \
                         "attached! Will fall back to World XY plane."
                rml = self.RuntimeMessageLevel.Warning
                self.AddRuntimeMessage(rml, errMsg)
            # create mesh from knitnetwork
            if isinstance(KN, KnitNetwork):
                Mesh = KN.create_mesh(mode=CyclesMode,
                                      max_valence=4)
            elif isinstance(KN, KnitDiNetwork):
                if KN.verify_dual_form():
                    Mesh = KnitNetwork(KN).create_mesh(mode=CyclesMode,
                                                       max_valence=4)
        elif Toggle and not KN:
            rml = self.RuntimeMessageLevel.Warning
            rMsg = "No KnitNetwork input!"
            self.AddRuntimeMessage(rml, rMsg)
        
        return Mesh
# ---------- end cmfkn ----------

# ----
# Create dual graph
# for 2d pattern generation
cyclesmode_2 = ValueList({"World XY Plane": -1, "Node Normal Plane": 0, "Average Normal Plane": 1, "Average Fit/Normal Plane": 2}, selected="Average Normal Plane")
mergeadjacentcreases = BooleanToggle(True)
mendtrailingrows = BooleanToggle(False)
knitnetwork_13 = Data(filter_3)
cknd = CreateKnitNetworkDual(
    Toggle=Toggle(True),
    KnitNetwork=knitnetwork_13,
    CyclesMode=cyclesmode_2,
    MergeAdjacentCreases=mergeadjacentcreases,
    MendTrailingRows=mendtrailingrows)  # -> KnitNetworkDual; inputs CyclesMode: Int32, MergeAdjacentCreases: Boolean, MendTrailingRows: Boolean
# ---------- cknd: Python ----------
"""
Create the dual network of a KnitNetwork. The supplied network should consist
of the finalized 'weft' and 'warp' edges. The resulting dual will have a node
for each cycle (quad or triangle) of the original network, each representing a
stitch for the knitting pattern.
Cycles with two 'warp' and two 'weft' edges represent a regular stitch.
Cycles with one 'warp' and two 'weft' edges represent the start or the end of
a short row.
Cycles with two 'warp' edges and one 'weft' edge represent an increase or
decrease of stitches, relative to the previous or next row of
stitches.
---
[NOTE] This algorithm relies on finding cycles (quads and triangles) for the
supplied network. This is not a trivial task in 3d space - at least to my
knowlege. Assigning a geometrybase to the KnitNetwork on initialization
and choosing cyclesmode 1 or 2 greatly improves reliability!
None the less, success is very dependent on the curvature of the original
surface or mesh used.
---
[WARNING] If the topology of the supplied network is not as 
expected, it will yield unpredictable results.
---
[IMPLEMENTATION DETAIL] N-Gons are deliberately ignored. The output will be of
type KnitDiNetwork.
    Inputs:
        Toggle: Set to True to activate the component.
                {item, bool}
        KnitNetwork: The KnitNetwork to create the dual network to.
                     {item, KnitNetwork}
        CyclesMode: Determines how the neighbors of each node are sorted when
                    finding the cycles of the network.
                    [-1] equals to using the world XY plane (default)
                    [0] equals to using a plane normal to the origin nodes 
                        closest point on the geometrybase
                    [1] equals to using a plane normal to the average of the 
                        origin and neighbor nodes' closest points on the
                        geometrybase
                    [2] equals to using an average plane between a plane fit to 
                        the origin and its neighbor nodes and a plane normal to 
                        the origin nodes closest point on the geometrybase.
                    Defaults to [-1].
                    {item, int}
        MergeAdjacentCreases: If True, will merge adjacent 'increase' and
                              'decrease' nodes connected by a 'weft' edge into a
                              single node. This effectively simplifies the
                              pattern, as a decrease is unneccessary to perform
                              if an increase is right beside it - both nodes
                              can be replaced by a single regular node (stitch).
                              Defaults to True.
                              {item, bool}
        MendTrailingRows: If True, will attempt to remove trailing rows at
                          the left and right bounds of the network by moving
                          increases and decreases that occur to the left or
                          right of the previous row inside of the bounds.
                          Defaults to False.
                          {item, bool}
    Outputs:
        KnitNetworkDual: The dual network of the input KnitNetwork.
                     {item, KnitNetwork}
    Remarks:
        Author: Max Eschenbach
        License: MIT License
        Version: 200705
"""

# PYTHON STANDARD LIBRARY IMPORTS
from __future__ import division

# GHPYTHON SDK IMPORTS
from ghpythonlib.componentbase import executingcomponent as component
import Grasshopper, GhPython
import System
import Rhino
import rhinoscriptsyntax as rs

# GHENV COMPONENT SETTINGS
ghenv.Component.Name = "CreateKnitNetworkDual"
ghenv.Component.NickName ="CKND"
ghenv.Component.Category = "Cockatoo"
ghenv.Component.SubCategory = "06 KnitNetwork"

# LOCAL MODULE IMPORTS
try:
    from cockatoo.exception import KnitNetworkTopologyError
except ImportError:
    errMsg = "The Cockatoo python module seems to be not correctly " + \
             "installed! Please make sure the module is in you search " + \
             "path, see README for instructions!."
    raise ImportError(errMsg)

class CreateKnitNetworkDual(component):
    
    def RunScript(self, Toggle, KnitNetwork, CyclesMode, MergeAdjacentCreases=True, MendTrailingRows=True):
        
        # sanitize inputs
        if CyclesMode == None:
            CyclesMode = -1
        elif CyclesMode < 0:
            CyclesMode = -1
        elif CyclesMode > 2:
            CyclesMode = 2
        
        # initialize Output
        Dual = Grasshopper.DataTree[object]()
        
        if Toggle and KnitNetwork:
            
            if CyclesMode != -1 and not KnitNetwork.graph["reference_geometry"]:
                errMsg = "KnitNetwork has no reference geometry " + \
                         "attached! Will fall back to World XY plane."
                rml = self.RuntimeMessageLevel.Warning
                self.AddRuntimeMessage(rml, errMsg)
            
            # CREATE DUAL ------------------------------------------------------
            try:
                Dual = KnitNetwork.create_dual(
                                    mode=CyclesMode,
                                    merge_adj_creases=MergeAdjacentCreases,
                                    mend_trailing_rows=MendTrailingRows)
            except NotImplementedError as e:
                if MendTrailingRows:
                    Dual = KnitNetwork.create_dual(
                                    mode=CyclesMode,
                                    merge_adj_creases=MergeAdjacentCreases,
                                    mend_trailing_rows=False)
                    rml = self.RuntimeMessageLevel.Warning
                    rMsg = "Not implemented option MendTrailingRows was ignored!"
                    self.AddRuntimeMessage(rml, rMsg)
                    self.AddRuntimeMessage(rml, e.message)
            except Exception as e:
                rml = self.RuntimeMessageLevel.Error
                rMsg = "Dual could not be created for the input network!"
                self.AddRuntimeMessage(rml, rMsg)
                self.AddRuntimeMessage(rml, e.message)
        
        elif Toggle and not KnitNetwork:
            rml = self.RuntimeMessageLevel.Warning
            rMsg = "No KnitNetwork input!"
            self.AddRuntimeMessage(rml, rMsg)
        
        # return the result
        return Dual
# ---------- end cknd ----------
knitnetworkdual = Data(cknd)

# ----
# Save the graph of the knitting pattern
# into different file formats
panel_2 = Panel("200813_KnitNetwork")
fileformat = ValueList({"GraphML": 0, "JSON": 1, "GML": 2, "DOT": 3}, selected="GraphML")
knitnetworkdual_2 = Data(knitnetworkdual)
wgtf = WriteGraphToFile(Toggle=Toggle(False), Graph=knitnetworkdual_2, FileFormat=fileformat, Name=panel_2)  # -> Folder; inputs Toggle: Boolean, FileFormat: Int32
# ---------- wgtf: Python ----------
"""
Writes a Graph to different data formats. The graph can be a KnitNetwork or a
graph prepared for GraphViz / Gephi.
---
Code for writing graph to dot file by Anders Holden Deleuran.
    Inputs:
        Toggle: Set to True to write the file.
                {item, boolean}
        Graph: A graph to write to the file. Can be either a KnitNetwork or a
               graph prepared for GraphViz / Gephi.
               {item, Graph / KnitNetwork}
        FileFormat: Selection of a file format used for writing. Can be GraphML,
                    JSON, GML or DOT.
                    [0] = GraphML
                    [1] = JSON
                    [2] = GML
                    [3] = DOT
                    Defaults to 0.
                    {item, int}
        Name: The filename of the file to write.
              {item, str}
    Output:
        Folder: The folder were the file was written.
                {item, str}
    Remarks:
        Author: Max Eschenbach
        License: MIT License
        Version: 200809
"""

# PYTHON STANDARD LIBRARY IMPORTS
from __future__ import division
import os
import json

# GPYTHON SDK IMPORTS
from ghpythonlib.componentbase import executingcomponent as component
import Grasshopper, GhPython
import System
import Rhino
import rhinoscriptsyntax as rs

# GHENV COMPONENT SETTINGS
ghenv.Component.Name = "WriteGraphToFile"
ghenv.Component.NickName ="WGTF"
ghenv.Component.Category = "Cockatoo"
ghenv.Component.SubCategory = "08 Visualisation"

# LOCAL MODULE IMPORTS
try:
    import cockatoo
    import networkx as nx
except ImportError:
    errMsg = "The Cockatoo python module seems to be not correctly " + \
             "installed! Please make sure the module is in you search " + \
             "path, see README for instructions!."
    raise ImportError(errMsg)

class WriteGraphToFile(component):
   
    def ensure_folder(self, foldername):
        """
        Ensures a specific subfolder inside the GH def folder.
        
        Based on code by Anders Holden Deleuran
        """
        
        if ghdoc.Path:
            folder = os.path.dirname(ghdoc.Path)
            folder = folder + "\\" + foldername
            if not os.path.isdir(folder):
                os.makedirs(folder)
            return folder
    
    def write_graph_to_json(self, graph, file):
        """
        Write a JSON Graph .json file.
        """
        
        json_data = nx.readwrite.adjacency_data(graph)
        
        jf = open(file, 'w')
        json.dump(json_data, jf)
        jf.close()
    
    def write_graph_to_graphml(self, graph, file):
        """
        Write a GraphML .graphml file.
        """
        
        nx.write_graphml(graph, file)
    
    def write_graph_to_gml(self, graph, file):
        """
        Write a GML .gml file.
        """
        
        nx.write_gml(graph, file)
    
    def write_graph_to_dot(self, graph, file, label="", dpi=72, node_sep=None):
        """
        Write and edit a dot file. Implements the pydot and dot_parser modules.
        
        Based on code by Anders Holden Deleuran.
        """
        
        nx.write_dot(graph, file)
        
        # Get the lines in the dot file
        df = open(file, 'r')
        df_lines = df.readlines()
        df.close()
        
        # Add additional properties to the dot file
        df_lines.insert(1, 'label="' + str(label) + '" dpi=' + str(dpi) + ' overlap=scalexy nodesep=' + str(node_sep) + ' rankdir=BT' + ';\n')
        df_string = ''.join(df_lines)
        
        # Open and overwrite dot file
        df = open(file, 'w')
        df.write(df_string)
        df.close()
    
    def RunScript(self, Toggle, Graph, FileFormat, Name):
        
        if FileFormat == None or FileFormat < 0:
            FileFormat = 0
        elif FileFormat > 3:
            FileFormat = 3
        
        if Toggle and Graph and FileFormat != None and Name:
            if FileFormat == 0:
                if isinstance(Graph, cockatoo.KnitNetworkBase):
                    Graph = cockatoo.KnitNetwork(Graph)
                    # sanitize graph attributes
                    if Graph.graph.has_key("reference_geometry"):
                        del Graph.graph["reference_geometry"]
                    # sanitize nodes
                    for node in Graph.node:
                        if Graph.node[node].has_key("geo"):
                            del Graph.node[node]["geo"]
                        for key in Graph.node[node]:
                            Graph.node[node][key] = str(Graph.node[node][key])
                    # sanitize edges
                    for edge in Graph.edges_iter(data=True):
                        if edge[2].has_key("geo"):
                            del edge[2]["geo"]
                        for key in edge[2]:
                            edge[2][key] = str(edge[2][key])
                
                folder = self.ensure_folder("GraphML")
                file = folder + "\\" + Name + ".graphml"
                self.write_graph_to_graphml(Graph, file)
            
            elif FileFormat == 1:
                if isinstance(Graph, cockatoo.KnitNetworkBase):
                    Graph = cockatoo.KnitNetwork(Graph)
                    # sanitize graph attributes
                    if Graph.graph.has_key("reference_geometry"):
                        del Graph.graph["reference_geometry"]
                    # sanitize nodes
                    for node in Graph.node:
                        if Graph.node[node].has_key("geo"):
                            del Graph.node[node]["geo"]
                        for key in Graph.node[node]:
                            Graph.node[node][key] = str(Graph.node[node][key])
                    # sanitize edges
                    for edge in Graph.edges_iter(data=True):
                        if edge[2].has_key("geo"):
                            del edge[2]["geo"]
                        for key in edge[2]:
                            edge[2][key] = str(edge[2][key])
                
                folder = self.ensure_folder("JSONGraph")
                file = folder + "\\" + Name + ".json"
                self.write_graph_to_json(Graph, file)
            
            elif FileFormat == 2:
                if isinstance(Graph, cockatoo.KnitNetworkBase):
                    Graph = cockatoo.KnitNetwork(Graph)
                    # sanitize graph attributes
                    if Graph.graph.has_key("reference_geometry"):
                        del Graph.graph["reference_geometry"]
                    # sanitize nodes
                    for node in Graph.node:
                        if Graph.node[node].has_key("geo"):
                            del Graph.node[node]["geo"]
                        for key in Graph.node[node]:
                            Graph.node[node][key] = str(Graph.node[node][key])
                    # sanitize edges
                    for edge in Graph.edges_iter(data=True):
                        if edge[2].has_key("geo"):
                            del edge[2]["geo"]
                        for key in edge[2]:
                            edge[2][key] = str(edge[2][key])
                
                folder = self.ensure_folder("GML")
                file = folder + "\\" + Name + ".gml"
                self.write_graph_to_gml(Graph, file)
            
            elif FileFormat == 3:
                if isinstance(Graph, cockatoo.KnitNetworkBase):
                    Graph = cockatoo.KnitNetwork(Graph)
                    # sanitize graph attributes
                    if Graph.graph.has_key("reference_geometry"):
                        del Graph.graph["reference_geometry"]
                    # sanitize nodes
                    for node in Graph.node:
                        if Graph.node[node].has_key("geo"):
                            del Graph.node[node]["geo"]
                        for key in Graph.node[node]:
                            Graph.node[node][key] = str(Graph.node[node][key])
                    # sanitize edges
                    for edge in Graph.edges_iter(data=True):
                        if edge[2].has_key("geo"):
                            del edge[2]["geo"]
                        for key in edge[2]:
                            edge[2][key] = str(edge[2][key])
                
                folder = self.ensure_folder("Dot")
                file = folder + "\\" + Name + ".dot"
                self.write_graph_to_dot(Graph, file)
            
            return folder
        else:
            if Toggle and not Graph:
                rml = self.RuntimeMessageLevel.Warning
                self.AddRuntimeMessage(rml, "No Graph / KnitNetwork input!")
            if Toggle and not Name:
                rml = self.RuntimeMessageLevel.Warning
                self.AddRuntimeMessage(rml, "No Name input!")
        
        return Grasshopper.DataTree[object]()
# ---------- end wgtf ----------
panel_3 = Panel(wgtf)

# ----
# Different stages
# of the process
# for visualisation
# Rendering and data display
knitnetworkdual_stitch_topology = Data(knitnetworkdual)
knitnetwork_knit_topology = Data(filter_3)
knitnetwork_initialised = Data(knitnetwork)
knitnetwork_courses = Data(knitnetwork_3)
knitmappingnetwork_2 = Data(knitmappingnetwork)
edgetextheight = Slider(0.0002, range=0.0001..0.1)
nodetextheight = Slider(0.0003, range=0..0.1)
rendercontouredgedata = BooleanToggle(False)
renderwarpedgedata = BooleanToggle(False)
renderweftedgedata = BooleanToggle(False)
rendercontouredges = BooleanToggle(False)
rendernodeindices = BooleanToggle(False)
renderwarpedges = BooleanToggle(True)
renderweftedges = BooleanToggle(True)
directionaldisplay = BooleanToggle(False)
rendernodedata = BooleanToggle(False)
rendernodes = BooleanToggle(False)
knitnetwork_14 = Data(knitnetwork_knit_topology)
xz = XZPlane(Origin=Point(0, 0, 0))
xz_2 = XZPlane(Origin=Point(0, 0, 0))
rkn = RenderKnitNetwork(
    KnitNetwork=knitnetwork_14,
    RenderNodes=rendernodes,
    RenderNodeIndices=rendernodeindices,
    RenderNodeData=rendernodedata,
    NodeTextPlane=xz,
    NodeTextHeight=nodetextheight,
    RenderContourEdges=rendercontouredges,
    RenderContourEdgeData=rendercontouredgedata,
    RenderWeftEdges=renderweftedges,
    RenderWeftEdgeData=renderweftedgedata,
    RenderWarpEdges=renderwarpedges,
    RenderWarpEdgeData=renderwarpedgedata,
    DirectionalDisplay=directionaldisplay,
    EdgeTextPlane=xz_2,
    EdgeTextHeight=edgetextheight)  # inputs RenderNodes: Boolean, RenderNodeIndices: Boolean, RenderNodeData: Boolean, NodeTextPlane: Plane, RenderContourEdges: Boolean, RenderContourEdgeData: Boolean, RenderWeftEdges: Boolean, RenderWeftEdgeData: Boolean, RenderWarpEdges: Boolean, RenderWarpEdgeData: Boolean, DirectionalDisplay: Boolean, EdgeTextPlane: Plane
# ---------- rkn: Python ----------
"""
Renders the nodes and edges of a given KnitNetwork to the Rhino viewport
according to the following rules:
[NODES]
'LEAF' : Cyan
'START' : Green
'END' : Blue
'INCREASE' : Red
'DECREASE' : Dark Red
'LEAF' + 'START' : Sea Green
'LEAF' + 'END' : Magenta
'LEAF' + 'START' + 'END' : Orange
'START' + 'END' : DarkGreen
'INCREASE' + 'END' : Purple
'DECREASE' + 'END' : Dark Violet
REGULAR NODES : Node Color or Black/White if no 'color' attribute is set.
---
[EDGES]
'WEFT' : Blue
'WARP' : Red
NEITHER 'WARP' NOR 'WEFT' : Gray
---
[WARNING] Rendering the associated data (attributes) as text or the directions
of the edges (DirectionalDisplay) can be **VERY** computation-intensive,
especially on large networks, and freeze Grasshopper & Rhino for a
substantial amount of time!
    Inputs:
        Toggle: {item, bool}
        KnitNetwork: A network of type KnitNetworkBase, this can be a
                     KnitNetwork, KnitMappingNetwork, KnitDiNetwork .
                     {item, KnitNetwork}
        RenderNodes: If True, colored nodes will be rendered to the viewport.
                     Defaults to False. {item, bool}
        RenderNodeIndices: If True, the identifiers of the nodes in the network
                           will be rendered to the viewport as text.
                           Defaults to False. {item, bool}
        RenderNodeData: If True, the associated data (attributes) of the nodes
                        will be rendered to the viewport as text. {item, bool}
        NodeTextPlane: The plane for orientation of the node identifiers and 
                       data text.
                       Defaults to World XZ. {item, plane}
        NodeTextHeight: The text size for the node identifiers and data in
                        model units.
                        Defaults to 0.1 . {item, float}
        RenderContourEdges: If True, the contour edges of the network will be
                            rendered to the viewport.
                            Defaults to False. {item, bool}
        RenderContourEdgeData: If True, the identifiers and associated data
                               (attributes) of contour edges will be rendered
                               to the viewport as text.
                               Defaults to False. {item, bool}
        RenderWeftEdges: If True, the 'weft' edges of the network will be
                         rendered to the viewport in blue.
                         Defaults to True. {item, bool}
        RenderWeftEdgeData: If True, the identifiers and associated data
                            (attributes) of 'weft' edges will be rendered
                            to the viewport as text.
                            Defaults to False. {item, bool}
        RenderWarpEdges: If True, the 'warp' edges of the network will be
                         rendered to the viewport in blue.
                         Defaults to True. {item, bool}
        RenderWarpEdgeData: If True, the identifiers and associated data
                            (attributes) of 'warp' edges will be rendered
                            to the viewport as text.
                            Defaults to False. {item, bool}
        DirectionalDisplay: If True, edges will be rendered as vectors instead
                            of using their associated line/polyline geometry.
                            Defaults to False. {item, bool}
        EdgeTextPlane: The plane for orientation of the edge identifiers and
                       data text.
                       Defaults to World XZ. {item, plane}
        EdgeTextHeight: The text size for the edge identifiers and data in
                        model units.
                        Defaults to 0.1 . {item, float}
    Remarks:
        Author: Max Eschenbach
        License: MIT License
        Version: 200705
"""

# PYTHON STANDARD LIBRARY IMPORTS
from __future__ import division

# GHPYTHON SDK IMPORTS
from ghpythonlib.componentbase import executingcomponent as component
import Grasshopper, GhPython
import System
import Rhino
import rhinoscriptsyntax as rs

# GHENV COMPONENT SETTINGS
ghenv.Component.Name = "RenderKnitNetwork"
ghenv.Component.NickName ="RKN"
ghenv.Component.Category = "Cockatoo"
ghenv.Component.SubCategory = "08 Visualisation"

# LOCAL MODULE IMPORTS
try:
    from cockatoo import KnitNetwork
    from cockatoo import KnitMappingNetwork
except ImportError:
    errMsg = "The Cockatoo python module seems to be not correctly " + \
             "installed! Please make sure the module is in you search " + \
             "path, see README for instructions!."
    raise ImportError(errMsg)

class RenderKnitNetwork(component):
    
    def __init__(self):
        super(RenderKnitNetwork, self).__init__()
        
        self.drawing_nodes = []
        self.drawing_edges = []
        self.drawing_data = []
        self.draw_directional = False
    
    def get_ClippingBox(self):
        return Rhino.Geometry.BoundingBox()
    
    def DrawViewportWires(self, args):
        try:
            
            # get display from args
            display = args.Display
            
            # draw all catalogued nodes
            for node in self.drawing_nodes:
                display.DrawPoint(node[0], node[1], node[2], node[3])
            
            # draw all catalogued edges
            if self.draw_directional:
                for edge in self.drawing_edges:
                    display.DrawArrow(edge[0], edge[1])
            else:
                for edge in self.drawing_edges:
                    display.DrawLine(edge[0], edge[1], 2)
            
            # draw all catalogued data text tags
            for txtag in self.drawing_data:
                if display.IsVisible(txtag[0].TextPlane.Origin):
                    display.Draw3dText(txtag[0], txtag[1])
            
        except Exception, e:
            System.Windows.Forms.MessageBox.Show(str(e),
                                                 "Error while drawing preview!")
    
    def RunScript(self, KN, RenderNodes=False, RenderNodeIndices=False, RenderNodeData=False, NodeTextPlane=None, NodeTextHeight=0.1, RenderContourEdges=False, RenderContourEdgeData=False, RenderWeftEdges=True, RenderWeftEdgeData=False, RenderWarpEdges=True, RenderWarpEdgeData=False, DirectionalDisplay=False, EdgeTextPlane=None, EdgeTextHeight=0.1):
        
        # SET DEFAULTS ---------------------------------------------------------
        
        if NodeTextPlane is None:
            NodeTextPlane = Rhino.Geometry.Plane.WorldZX
            NodeTextPlane.Flip()
        
        if EdgeTextPlane is None:
            EdgeTextPlane = Rhino.Geometry.Plane.WorldZX
            EdgeTextPlane.Flip()
        
        if DirectionalDisplay is None:
            DirectionalDisplay = False
        
        # set directional drawing attribute for drawing method
        self.draw_directional = DirectionalDisplay
        
        # SET FONT FACES FOR DISPLAY -------------------------------------------
        
        nodeFontFace = "Helvetica"
        contourFontFace = "Helvetica"
        weftFontFace = "Helvetica"
        warpFontFace = "Helvetica"
        
        # RENDER ACCORDING TO SET PARAMETERS -----------------------------------
        
        node_drawing_list = []
        edge_drawing_list = []
        data_drawing_list = []
        
        if KN and (RenderNodes or \
                   RenderContourEdges or \
                   RenderWeftEdges or \
                   RenderWarpEdges):
            
            # RENDERING OF CONTOUR EDGES ---------------------------------------
            
            if RenderContourEdges:
                contourcol = System.Drawing.Color.Gray
                contour_edges = KN.contour_edges
                
                for ce in contour_edges:
                    egeo = ce[2]["geo"]
                    if isinstance(egeo, Rhino.Geometry.Polyline):
                        for seg in egeo.GetSegments():
                            edge_drawing_list.append((seg, contourcol))
                    else:
                        edge_drawing_list.append((egeo, contourcol))
                    
                    # RENDERING OF CONTOUR EDGE DATA ---------------------------
                    if RenderContourEdgeData:
                        EdgeTextPlane.Origin = egeo.PointAt(0.5)
                        edgeLabel = [(k, ce[2][k]) for k \
                                     in ce[2] if k != "geo"]
                        edgeLabel = ["{}: {}".format(t[0], t[1]) for t \
                                     in edgeLabel]
                        edgeLabel.sort()
                        edgeLabel = [str(ce[0]) + "-" + \
                                     str(ce[1])] + edgeLabel
                        edgeLabel = "\n".join(edgeLabel)
                        tagTxt = Rhino.Display.Text3d(str(edgeLabel),
                                                      EdgeTextPlane,
                                                      EdgeTextHeight)
                        tagTxt.FontFace = contourFontFace
                        
                        data_drawing_list.append((tagTxt, contourcol))
            
            # RENDERING OF WEFT EDGES ------------------------------------------
            
            if RenderWeftEdges:
                weftcol = System.Drawing.Color.Blue
                weft_edges = KN.weft_edges
                for weft in weft_edges:
                    egeo = weft[2]["geo"]
                    edge_drawing_list.append((egeo, weftcol))
                    
                    # RENDERING OF WEFT DGE DATA -------------------------------
                    
                    if RenderWeftEdgeData:
                        EdgeTextPlane.Origin = egeo.PointAt(0.5)
                        edgeLabel = [(k, weft[2][k]) for k \
                                     in weft[2] if k != "geo"]
                        edgeLabel = ["{}: {}".format(t[0], t[1]) for t \
                                     in edgeLabel]
                        edgeLabel.sort()
                        edgeLabel = [str(weft[0]) + "-" + \
                                     str(weft[1])] + edgeLabel
                        edgeLabel = "\n".join(edgeLabel)
                        tagTxt = Rhino.Display.Text3d(str(edgeLabel),
                                                      EdgeTextPlane,
                                                      EdgeTextHeight)
                        tagTxt.FontFace = weftFontFace
                        data_drawing_list.append((tagTxt, weftcol))
            
            # RENDERING OF WARP EDGES ------------------------------------------
            
            if RenderWarpEdges:
                warpcol = System.Drawing.Color.Red
                warp_edges = KN.warp_edges
                for warp in warp_edges:
                    egeo = warp[2]["geo"]
                    edge_drawing_list.append((egeo, warpcol))
                    
                    # RENDERING OF WARP EDGE DATA ------------------------------
                    
                    if RenderWarpEdgeData:
                        EdgeTextPlane.Origin = egeo.PointAt(0.5)
                        edgeLabel = [(k, warp[2][k]) for k \
                                     in warp[2] if k != "geo"]
                        edgeLabel = ["{}: {}".format(t[0], t[1]) for t \
                                     in edgeLabel]
                        edgeLabel.sort()
                        edgeLabel = [str(warp[0]) + "-" + \
                                     str(warp[1])] + edgeLabel
                        edgeLabel = "\n".join(edgeLabel)
                        tagTxt = Rhino.Display.Text3d(str(edgeLabel),
                                                      EdgeTextPlane,
                                                      EdgeTextHeight)
                        tagTxt.FontFace = warpFontFace
                        data_drawing_list.append((tagTxt, warpcol))
            
            # RENDERING OF NODES -----------------------------------------------
            
            # define point styles for nodes
            psEnd = Rhino.Display.PointStyle.Circle
            psLeaf = Rhino.Display.PointStyle.Circle
            psRegular = Rhino.Display.PointStyle.RoundControlPoint
            
            # define colours for nodes and node texts
            colStart = System.Drawing.Color.Green
            colStartLeaf = System.Drawing.Color.SeaGreen
            colStartLeafEnd = System.Drawing.Color.Orange
            colStartEnd = System.Drawing.Color.DarkGreen
            colEnd = System.Drawing.Color.Blue
            colLeaf = System.Drawing.Color.Cyan
            colEndLeaf = System.Drawing.Color.Magenta
            colRegular = System.Drawing.Color.Black
            colIncreaseEnd = System.Drawing.Color.Purple
            colDecreaseEnd = System.Drawing.Color.DarkViolet
            colIncrease = System.Drawing.Color.Red
            colDecrease = System.Drawing.Color.DarkRed
            
            if RenderNodes or RenderNodeIndices or RenderNodeData:
                nodes = KN.nodes(data=True)
                for i, node in enumerate(nodes):
                    data = node[1]
                    
                    # END BUT NOT LEAF
                    if data["end"] and not data["leaf"]:
                        if not data["increase"] and not data["decrease"]:
                            if data["start"]:
                                nodecol = colStartEnd
                            else:
                                nodecol = colEnd
                            pStyle = psEnd
                            pSize = 3
                        elif data["increase"] and not data["decrease"]:
                            nodecol = colIncreaseEnd
                            pStyle = psEnd
                            pSize = 3
                        elif not data["increase"] and data["decrease"]:
                            nodecol = colDecreaseEnd
                            pStyle = psEnd
                            pSize = 3
                    # END AND LEAF
                    elif data["end"] and data["leaf"]:
                        if data["start"]:
                            nodecol = colStartLeafEnd
                        else:
                            nodecol = colEndLeaf
                        pStyle = psLeaf
                        pSize = 3
                    # NO END BUT LEAF
                    elif not data["end"] and data["leaf"]:
                        if data["start"]:
                            nodecol = colStartLeaf
                        else:
                            nodecol = colLeaf
                        pStyle = psLeaf
                        pSize = 3
                    # NO END NO LEAF
                    elif not data["end"] and not data["leaf"]:
                        if data["increase"] and not data["decrease"]:
                            nodecol = colIncrease
                            pStyle = psEnd
                            pSize = 3
                        elif not data["increase"] and data["decrease"]:
                            nodecol = colDecrease
                            pStyle = psEnd
                            pSize = 3
                        else:
                            if data["color"]:
                                nodecol = System.Drawing.Color.FromArgb(
                                                            *data["color"])
                            else:
                                nodecol = colRegular
                            pStyle = psRegular
                            pSize = 2
                    
                    
                    
                    if RenderNodes:
                        node_drawing_list.append((data["geo"], pStyle, pSize, nodecol))
                    
                    # RENDER NODE DATA AND INDICES -----------------------------
                    
                    if RenderNodeIndices or RenderNodeData:
                        NodeTextPlane.Origin = data["geo"]
                        tagTxt = Rhino.Display.Text3d(str(node[0]),
                                                          NodeTextPlane,
                                                          NodeTextHeight)
                        tagTxt.FontFace = nodeFontFace
                        if data["end"] == True:
                            nodecol = colEnd
                        elif data["leaf"] == True:
                            nodecol = colLeaf
                        elif data["leaf"] == False and data["end"] == False:
                            nodecol = colRegular
                        data_drawing_list.append((tagTxt, nodecol))
                        
                        if RenderNodeData:
                            nodeLabel = [(k, data[k]) for k in data \
                                         if k != "geo" and \
                                            k != "x" and \
                                            k != "y" and \
                                            k != "z"]
                            nodeLabel = ["{}: {}".format(t[0], t[1]) \
                                         for t in nodeLabel]
                            nodeLabel.sort()
                            nodeLabel = [""] + nodeLabel
                            nodeLabel = "\n".join(nodeLabel)
                            nodeTxt = Rhino.Display.Text3d(str(nodeLabel),
                                                          NodeTextPlane,
                                                          NodeTextHeight*0.3)
                            nodeTxt.FontFace = nodeFontFace
                            data_drawing_list.append((nodeTxt, nodecol))
            
            # set attributes and draw
            self.drawing_nodes = node_drawing_list
            self.drawing_edges = edge_drawing_list
            self.drawing_data = data_drawing_list
            
        else:
            if not KN:
                self.drawing_nodes = []
                self.drawing_edges = []
                self.drawing_data = []
                rml = self.RuntimeMessageLevel.Warning
                self.AddRuntimeMessage(rml, "No KnitNetwork input!")
# ---------- end rkn ----------

# ----
# CAREFUL!
# Save your file before running this!
# 
# The topological sort can crash rhino
# in some situations. This is currently
# beyond my control, I will try to fix it
# in a future release, though.
toggle_4 = BooleanToggle(False)

# ----
# Make 2d pattern and pixel data
colormode = ValueList({"Prioritize Instruction": 0, "Prioritize Color": 1, "Blend Colors": 2}, selected="Prioritize Instruction")
consolidate = BooleanToggle(True)
decreasecolor = ColourSwatch(SwatchColor=RGB(255, 0, 0))
increasecolor = ColourSwatch(SwatchColor=RGB(24, 178, 0))
stitchcolor = ColourSwatch(SwatchColor=RGB(255, 255, 255))
fillercolor = ColourSwatch(SwatchColor=RGB(217, 217, 217))
endcolor = ColourSwatch(SwatchColor=RGB(0, 136, 255))
knitnetworkdual_3 = Data(knitnetworkdual)
mpd = MakePatternData(
    Toggle=toggle_4,
    KnitNetworkDual=knitnetworkdual_3,
    Consolidate=consolidate,
    ColorMode=colormode,
    FillerColor=fillercolor,
    StitchColor=stitchcolor,
    IncreaseColor=increasecolor,
    DecreaseColor=decreasecolor,
    EndColor=endcolor)  # -> PatternData, PixelData; inputs Toggle: Boolean, Consolidate: Boolean, ColorMode: Int32, FillerColor: Color, StitchColor: Color, IncreaseColor: Color, DecreaseColor: Color, EndColor: Color
# ---------- mpd: Python ----------
"""
Make knitting pattern data from a KnitNetwork dual. This will convert the input
dual network into a directed acyclic graph by grouping all 'weft' edge chains
and 'warp' edge chains. Then, a topological sort is performed on that graph to
sort the stitches into rows and columns.
---
[NOTE] If this fails, something is wrong with the topology or geometry of the
dual network or the underlying KnitNetwork and thus it can not be represented as
a directed acyclic graph.
---
[WARNING]
SAVE YOUR FILE before activating this! It can crash rhino and grasshopper for
reasons currently unknown. 
---
For more details on the underlying concepts see
https://en.wikipedia.org/wiki/Directed_acyclic_graph
https://en.wikipedia.org/wiki/Topological_sorting
    Inputs:
        Toggle: Set to True to activate the component. {item, boolean}
        KnitNetworkDual: The input dual network of the KnitNetwork.
                         {item, KnitDiNetwork}
        Consolidate: If True, will try to consolidate the pattern data
                     Defaults to False.
                     {item, bool}
        ColorMode: Determines how node colors wil be treated when generating
                   the pattern data.
                   [0] will prioritize colors for instructions like increases
                       or decreases over the 'color' attribute of the node if
                       set.
                   [1] will prioritize the 'color' attribute of the node if set.
                   [2] will create a blended color between the instruction color
                       and the node color specified through the 'color'
                       attribute.
                   Defaults to [0].
                   {item, int}
        FillerColor: Color to use for filling pixels without stitch information.
                     Defaults to Black.
                     {item, System.Drawing.Color}
        StitchColor: Color to use for regular stitch pixels if no 'color'
                     attribute is assigned to the node.
                     Defaults to White.
                     {item, System.Drawing.Color}
        IncreaseColor: Color to use for stitch pixels marked as 'increase'.
                       Defaults to Green.
                       {item, System.Drawing.Color}
        DecreaseColor: Color to use for stitch pixels marked as 'decrease'.
                       Defaults to Orange.
                       {item, System.Drawing.Color}
        EndColor: Color to use for stitch pixels marked as 'end'.
                  Defaults to Blue.
                  {item, System.Drawing.Color}
    Outputs:
        PatternData: The 2d pattern data as a matrix of rows and columns.
                     Contains the node indices. The value '-1' is used as a
                     filler.
                     {tuple, int}
        PixelData: The 2d pixel data as a matrix of rows and columns.
                   Contains the colors of each stitch as as System Color.
                   {tuple, System.Drawing.Color}
    Remarks:
        Author: Max Eschenbach
        License: MIT License
        Version: 200813
"""

# PYTHON STANDARD LIBRARY IMPORTS
from __future__ import division

# GHPYTHON SDK IMPORTS
from ghpythonlib.componentbase import executingcomponent as component
import Grasshopper, GhPython
import System
import Rhino
import rhinoscriptsyntax as rs

# THIRD PARTY MODULE IMPORTS
from ghpythonlib import treehelpers as th

# GHENV COMPONENT SETTINGS
ghenv.Component.Name = "MakePatternData"
ghenv.Component.NickName ="MPD"
ghenv.Component.Category = "Cockatoo"
ghenv.Component.SubCategory = "09 Pattern Data"

# LOCAL MODULE IMPORTS
try:
    import cockatoo
except ImportError:
    errMsg = "The Cockatoo python module seems to be not correctly " + \
             "installed! Please make sure the module is in you search " + \
             "path, see README for instructions!."
    raise ImportError(errMsg)

class MakePatternData(component):
    
    def RunScript(self, Toggle, DualNetwork, Consolidate, ColorMode, FillerColor, StitchColor, IncreaseColor, DecreaseColor, EndColor):
        
        # set defaults and snitize inputs
        if Consolidate == None:
            Consolidate=False
        if ColorMode == None or ColorMode < 0:
            ColorMode = 0
        elif ColorMode > 2:
            ColorMode = 2
        if FillerColor == None:
            FillerColor = System.Drawing.Color.Black
        if StitchColor == None:
            StitchColor = System.Drawing.Color.White
        if IncreaseColor == None:
            IncreaseColor = System.Drawing.Color.Green
        if DecreaseColor == None:
            DecreaseColor = System.Drawing.Color.Orange
        if EndColor == None:
            EndColor = System.Drawing.Color.Blue
        
        PatternData = Grasshopper.DataTree[object]()
        PixelData = Grasshopper.DataTree[object]()
        
        if Toggle and DualNetwork:
            # CREATE PATTERN DATA (ROWS AND COLUMNS) ---------------------------
            
            try:
                PatternData = DualNetwork.make_pattern_data(
                                                    consolidate=Consolidate)
                PatternData = tuple([tuple(row) for row in PatternData])
            except Exception as e:
                rml = self.RuntimeMessageLevel.Error
                rMsg = "Could not perform topological sort on input network!"
                self.AddRuntimeMessage(rml, rMsg)
                print(e.message)
            
            # CONVERT PATTERN DATA TO PIXELS -----------------------------------
            try:
                PixelData = []
                for i, row in enumerate(PatternData):
                    pixel_row = []
                    for node in row:
                        # set filler color if this is not a valid node
                        if node < 0:
                            pixel_row.append(FillerColor)
                            continue
                        
                        # get node data and color
                        node_data = DualNetwork.node[node]
                        node_col = node_data["color"]
                        
                        # END NODE PIXEL COLOR ---------------------------------
                        if node_data["end"]:
                            if node_col and ColorMode == 1:
                                syscol = System.Drawing.Color.FromArgb(
                                                            *node_col)
                                pixel_row.append(syscol)
                            elif node_col and ColorMode == 2:
                                rgbcol = (EndColor.R,
                                          EndColor.G,
                                          EndColor.B)
                                blend = cockatoo.utilities.blend_colors(
                                                    rgbcol,
                                                    node_col)
                                sysblend = System.Drawing.Color.FromArgb(
                                                            *blend)
                                pixel_row.append(sysblend)
                            else:
                                if node_data["increase"]:
                                    pixel_row.append(IncreaseColor)
                                elif node_data["decrease"]:
                                    pixel_row.append(DecreaseColor)
                                else:
                                    pixel_row.append(EndColor)
                        
                        # INCREASE NODE PIXEL COLOR ----------------------------
                        elif node_data["increase"]:
                            if node_col and ColorMode == 1:
                                syscol = System.Drawing.Color.FromArgb(
                                                            *node_col)
                                pixel_row.append(syscol)
                            elif node_col and ColorMode == 2:
                                rgbcol = (IncreaseColor.R,
                                          IncreaseColor.G,
                                          IncreaseColor.B)
                                blend = cockatoo.utilities.blend_colors(
                                                    rgbcol,
                                                    node_col)
                                sysblend = System.Drawing.Color.FromArgb(
                                                            *blend)
                                pixel_row.append(sysblend)
                            else:
                                pixel_row.append(IncreaseColor)
                        
                        # DECREASE NODE PIXEL COLOR ----------------------------
                        elif node_data["decrease"]:
                            if node_col and ColorMode == 1:
                                syscol = System.Drawing.Color.FromArgb(
                                                            *node_col)
                                pixel_row.append(syscol)
                            elif node_col and ColorMode == 2:
                                rgbcol = (DecreaseColor.R,
                                          DecreaseColor.G,
                                          DecreaseColor.B)
                                blend = cockatoo.utilities.blend_colors(
                                                    rgbcol,
                                                    node_col)
                                sysblend = System.Drawing.Color.FromArgb(
                                                            *blend)
                                pixel_row.append(sysblend)
                            else:
                                pixel_row.append(DecreaseColor)
                        
                        # REGULAR NODE PIXEL COLOR -----------------------------
                        else:
                            if node_col:
                                syscol = System.Drawing.Color.FromArgb(
                                                                *node_col)
                                pixel_row.append(syscol)
                            else:
                                pixel_row.append(StitchColor)
                    
                    # append row to pixel data
                    PixelData.append(pixel_row)
                
                PixelData = tuple([tuple(row) for row in PixelData])
                
            except Exception as e:
                rml = self.RuntimeMessageLevel.Error
                rMsg = "Could not convert pattern data to pixel colors!"
                self.AddRuntimeMessage(rml, rMsg)
                print(e.message)
        
        elif Toggle and not DualNetwork:
            rml = self.RuntimeMessageLevel.Warning
            rMsg = "No DualNetwork input!"
            self.AddRuntimeMessage(rml, rMsg)
        
        return PatternData, PixelData
# ---------- end mpd ----------
patterndata = Data(mpd.PatternData)
pixeldata = Data(mpd.PixelData)

# ----
# Export to bitmap
write = BooleanToggle(False)
path = FilePath("C:\Users\EFESTWIN\Desktop\200802_Cockatoo_Pattern.bmp")
pixeldata_2 = Data(pixeldata)
wkptb = WriteKnittingPatternToBitmap(Write=write, PixelData=pixeldata_2, Path=path)  # inputs Write: Boolean, PixelData: list
# ---------- wkptb: Python ----------
"""
Write knitting pattern data to a bitmap file.
---
Based on an example by Anders Holden Deleuran
https://discourse.mcneel.com/t/write-a-bitmap-pixel-by-pixel-in-python/81116/2
    Inputs:
        Write: Set to True to save the bitmap file.
               {item, bool}
        PixelData: The knitting pattern pixel data to write to the bitmap file.
                   Use the MakePatternData component to obtain the pixel data
                   for a KnitNetwork.
                   {item, PixelData}
        Path: The file path to a .bmp file where the knitting pattern should
              be written.
              {item, str}
    Remarks:
        Author: Max Eschenbach
        License: MIT License
        Version: 200813
"""

# PYTHON STANDARD LIBRARY IMPORTS
from __future__ import division
from os import path

# GHPYTHON SDK IMPORTS
from ghpythonlib.componentbase import executingcomponent as component
import Grasshopper, GhPython
import System
import Rhino
import rhinoscriptsyntax as rs

# GHENV COMPONENT SETTINGS
ghenv.Component.Name = "WriteKnittingPatternToBitmap"
ghenv.Component.NickName ="WKPTB"
ghenv.Component.Category = "Cockatoo"
ghenv.Component.SubCategory = "09 Pattern Data"

class WriteKnittingPatternToBitmap(component):
    
    def RunScript(self, Write, PixelData, Path):
        
        if Write and PixelData and Path:
            # reverse the data so that the start is at the bottom of the image
            PixelData.reverse()
            
            # Get number of columns and rows in csv data
            columns = max([len(row) for row in PixelData])
            rows = len(PixelData)
            
            # initialize empty bitmap
            bitmap = System.Drawing.Bitmap(columns, rows)
            
            # add pixels
            for i in range(columns):
                for j in range(rows):
                    
                    try:
                        col = PixelData[j][i]
                    except IndexError:
                        col = System.Drawing.Color.Gray
                    
                    # set pixel
                    bitmap.SetPixel(i, j, col)
                    
            # save to file
            bitmap.Save(path.normpath(Path.strip("\n\r")),
                        System.Drawing.Imaging.ImageFormat.Bmp)
        
        else:
            if not PixelData:
                rml = self.RuntimeMessageLevel.Warning
                self.AddRuntimeMessage(rml, "No PixelData input!")
            if not Path:
                rml = self.RuntimeMessageLevel.Warning
                self.AddRuntimeMessage(rml, "No Path input!")
# ---------- end wkptb ----------

# ----
# Visualise 2d pattern data
# 
# (activate preview to see)
number_slider_4 = Slider(0.04, range=0.001..1)
paddingx = Slider(0.05, range=0..1)
paddingy = Slider(0.05, range=0..1)
directionaldisplay_2 = BooleanToggle(False)
nodedisplay = ValueList({"Circle": 0, "Square": 1}, selected="Circle")
drawdata = BooleanToggle(False)
knitnetworkdual_4 = Data(knitnetworkdual)
xy = XYPlane(Origin=Point(0, 0, 0))
patterndata_2 = Data(patterndata)
vpd = VisualisePatternData(
    KnitNetworkDual=knitnetworkdual_4,
    PatternData=patterndata_2,
    Plane=xy,
    NodeRadius=number_slider_4,
    NodeDisplay=nodedisplay,
    PaddingX=paddingx,
    PaddingY=paddingy,
    DirectionalDisplay=directionaldisplay_2,
    DrawData=drawdata)  # -> FlatDual, NodeCurves, WeftEdgeLines, WarpEdgeLines, TextTags; inputs PatternData: list, Plane: Plane, NodeDisplay: Int32, DirectionalDisplay: Boolean, DrawData: Boolean
# ---------- vpd: Python ----------
"""
Draws a custom 2d graph layout of a KnitNetwork and the corresponding 2d pattern
data.
---
[WARNING!]
Be careful when using the DrawData parameter. Drawing of text tags is very slow
in rhino and since there are a looooot of text tags in such a graph, it may
become unresponsive for quite some time. Definitely save your file before
switching this to True!
    Inputs:
        KnitNetworkDual: The dual graph of the KnitNetwork.
                         {item, KnitDiNetwork)
        PatternData: The topological sorted 2d pattern data optained from the
                     MakePatternData component.
                     {item, PatternData}
        Plane: The plane to draw the graph layout onto.
               {item, plane}
        NodeRadius: The radius (i.e. size) of the nodes to draw.
                    {item, float}
        NodeDisplay: Display nodes either as circles or as squares.
                     [0] = circle
                     [1] = square
                     {item, int}
        PaddingX: The spacing between nodes in plane x-direction.
                  {item, float}
        PaddingY: The spacing between the nodes in plane y-direction.
                  {item, float}
        DirectionalDisplay: Set to True to draw arrows for edges instead of
                            undirected lines.
                            {item, bool}
        DrawData: Set to True to also draw the attributes as text tags. This
                  can be very slow!
                  {item, bool}
    Outputs:
        FlatDual: A 'falt' version of the KnitNetworkDual where all nodes and
                  edges are on the defined plane.
                  {item, KnitDiNetwork}
        NodeCurves: The circles/squares that are used for drawing the nodes.
                    {list, curve}
        WeftEdgeLines: The lines that are used for drawing the 'weft' edges.
                       {list, line}
        WarpEdgeLines: The lines that are used for drawing the 'warp' edges.
                       {list, line}
        TextTags: If DrawData is True, the text tags with all the attributes of
                  nodes and edges.
                  {list, TextGoo}
    Outputs:
    Remarks:
        Author: Max Eschenbach
        License: MIT License
        Version: 200813
"""

# PYTHON STANDARD LIBRARY IMPORTS
from __future__ import division
from math import sqrt

# GHPYTHON SDK IMPORTS
from ghpythonlib.componentbase import executingcomponent as component
import Grasshopper, GhPython
import System
import Rhino
import rhinoscriptsyntax as rs

# ADDITIONAL MODULE IMPORTS
from ghpythonlib import treehelpers as th
from scriptcontext import doc

# GHENV COMPONENT SETTINGS
ghenv.Component.Name = "VisualisePatternData"
ghenv.Component.NickName ="VPD"
ghenv.Component.Category = "Cockatoo"
ghenv.Component.SubCategory = "08 Visualisation"

# LOCAL MODULE IMPORTS
try:
    import cockatoo
except ImportError:
    errMsg = "The Cockatoo python module seems to be not correctly " + \
             "installed! Please make sure the module is in you search " + \
             "path, see README for instructions!."
    raise ImportError(errMsg)

class TextGoo(Grasshopper.Kernel.Types.GH_GeometricGoo[Rhino.Display.Text3d], Grasshopper.Kernel.IGH_BakeAwareData, Grasshopper.Kernel.IGH_PreviewData):
    """
    Custom TextGoo class.
    Based on an example by Giulio Piacentino & David Rutten.
    https://discourse.mcneel.com/t/creating-text-objects-and-outputting-them-as-normal-rhino-geometry/47834/10
    """
    
    #region construction
    def __init__(self, text):
        self.m_value = text
    
    @staticmethod
    def DuplicateText3d(original):
        if original is None: return None
        text = Rhino.Display.Text3d(original.Text, original.TextPlane, original.Height)
        text.Bold = original.Bold,
        text.Italic = original.Italic,
        text.FontFace = original.FontFace
        return text
    
    def DuplicateGeometry(self):
        return TextGoo(TextGoo.DuplicateText3d(self.m_value))
    
    #region properties
    def get_TypeName(self):
        return "3D Text"
        
    def get_TypeDescription(self):
        return "3D Text"
    
    def ToString(self):
        if self.m_value is None: return "<null>"
        return self.m_value.Text
        
    def get_Boundingbox(self):
        if self.m_value is None:
            return Rhino.Geometry.BoundingBox.Empty;
        return self.m_value.BoundingBox;
        
    def GetBoundingBox(self, xform):
        if self.m_value is None:
            return Rhino.Geometry.BoundingBox.Empty
        box = self.m_value.BoundingBox
        corners = xform.TransformList(box.GetCorners())
        return Rhino.Geometry.BoundingBox(corners)
    
    #region methods
    def Transform(self, xform):
        text = TextGoo.DuplicateText3d(self.m_value)
        if text is None: return TextGoo(None)
        
        plane = text.TextPlane
        point = plane.PointAt(1, 1)
        
        plane.Transform(xform)
        point.Transform(xform)
        dd = point.DistanceTo(plane.Origin)
        
        text.TextPlane = plane;
        text.Height *= dd / sqrt(2)
        return TextGoo(text)
        
    def Morph(self, xmorph):
        return self.DuplicateGeometry()

    #region preview
    def get_ClippingBox(self):
        return self.get_Boundingbox()
        
    def DrawViewportWires(self, args):
        if self.m_value is None: return
        args.Pipeline.Draw3dText(self.m_value, args.Color)
      
    def DrawViewportMeshes(self, args):
        # Do not draw in meshing layer.
        pass

    #region baking
    def BakeGeometry(self, doc, att, id):
        id = System.Guid.Empty
        
        if self.m_value is None:
            return false, id
        
        if att is None:
            att = doc.CreateDefaultAttributes()
        
        id = doc.Objects.AddText(self.m_value, att)
        
        return True, id


class VisualisePatternData(component):
    
    def __init__(self):
        super(VisualisePatternData, self).__init__()
        
        self.drawing_nodes = []
        self.drawing_edges = []
        self.drawing_data = []
        self.draw_directional = False
        self.node_display = 0
    
    def get_ClippingBox(self):
        return Rhino.Geometry.BoundingBox()
    
    def DrawViewportWires(self, args):
        try:
            # get display from args
            display = args.Display
            
            # draw all catalogued nodes
            for node in self.drawing_nodes:
                node_display = self.node_display
                if node_display == 0:
                #display.DrawPoint(node[0], node[1], node[2], node[3])
                    display.DrawCircle(node[0], node[1])
                elif node_display == 1:
                    display.DrawCurve(node[0], node[1])
            
            # draw all catalogued edges
            if self.draw_directional:
                for edge in self.drawing_edges:
                    display.DrawArrow(edge[0], edge[1])
            else:
                for edge in self.drawing_edges:
                    display.DrawLine(edge[0], edge[1], 2)
            
            # draw all catalogued data text tags
            for txtag in self.drawing_data:
                if display.IsVisible(txtag[0].TextPlane.Origin):
                    display.Draw3dText(txtag[0], txtag[1])
        
        except Exception, e:
            System.Windows.Forms.MessageBox.Show(str(e),
                                                 "Error while drawing preview!")
    
    def node_color(self, data):
        """
        checks the node and returns the appropriate drawing color
        """
        
        # define colours for nodes and node texts
        colStart = System.Drawing.Color.Green
        colStartLeaf = System.Drawing.Color.SeaGreen
        colStartLeafEnd = System.Drawing.Color.Orange
        colStartEnd = System.Drawing.Color.DarkGreen
        colEnd = System.Drawing.Color.Blue
        colLeaf = System.Drawing.Color.Cyan
        colEndLeaf = System.Drawing.Color.Magenta
        colRegular = System.Drawing.Color.Black
        colIncreaseEnd = System.Drawing.Color.Purple
        colDecreaseEnd = System.Drawing.Color.DarkViolet
        colIncrease = System.Drawing.Color.Red
        colDecrease = System.Drawing.Color.DarkRed
        
        # END BUT NOT LEAF
        if data["end"] and not data["leaf"]:
            if not data["increase"] and not data["decrease"]:
                if data["start"]:
                    nodecol = colStartEnd
                else:
                    nodecol = colEnd
            elif data["increase"] and not data["decrease"]:
                nodecol = colIncreaseEnd
            elif not data["increase"] and data["decrease"]:
                nodecol = colDecreaseEnd
        # END AND LEAF
        elif data["end"] and data["leaf"]:
            if data["start"]:
                nodecol = colStartLeafEnd
            else:
                nodecol = colEndLeaf
        # NO END BUT LEAF
        elif not data["end"] and data["leaf"]:
            if data["start"]:
                nodecol = colStartLeaf
            else:
                nodecol = colLeaf
        # NO END NO LEAF
        elif not data["end"] and not data["leaf"]:
            if data["increase"] and not data["decrease"]:
                nodecol = colIncrease
            elif not data["increase"] and data["decrease"]:
                nodecol = colDecrease
            else:
                if data["color"]:
                    nodecol = System.Drawing.Color.FromArgb(
                                                *data["color"])
                else:
                    nodecol = colRegular
        
        # return the color
        return nodecol
    
    def RunScript(self, KnitNetworkDual, PatternData, Plane, NodeRadius, NodeDisplay, PaddingX, PaddingY, DirectionalDisplay, DrawData):
        
        # set defaults and catch missing params
        if NodeRadius == None:
            NodeRadius = 0.1
        if PaddingX == None:
            PaddingX = NodeRadius * 1.5
        if PaddingY == None:
            PaddingY = NodeRadius * 1.5
        if NodeDisplay == None or NodeDisplay < 0:
            NodeDisplay = 0
        elif NodeDisplay > 1:
            NodeDisplay = 1
        if DirectionalDisplay == None:
            DirectionalDisplay = False
        if Plane == None:
            Plane = Rhino.Geometry.Plane.WorldXY
        
        self.drawing_nodes = []
        self.drawing_edges = []
        self.drawing_data = []
        
        # set directional display
        self.draw_directional = DirectionalDisplay
        self.node_display = NodeDisplay
        
        # set font faces for display/drawing
        nodeFontFace = "Helvetica"
        contourFontFace = "Helvetica"
        weftFontFace = "Helvetica"
        warpFontFace = "Helvetica"
        
        # set edge colors for display/drawing
        contourcol = System.Drawing.Color.Gray
        weftcol = System.Drawing.Color.Blue
        warpcol = System.Drawing.Color.Red
        
        # create a copy version of the knitnetwork
        FlatDual = cockatoo.KnitDiNetwork(KnitNetworkDual)
        
        if FlatDual and PatternData:
            
            # set origin
            origin = Plane.Origin
            origin += Plane.XAxis * NodeRadius
            origin += Plane.YAxis * NodeRadius
            
            # modify the padding according to node radius
            PaddingX += NodeRadius * 2
            PaddingY += NodeRadius * 2
            
            # create containers for the geometry data
            grid = [[] for row in PatternData]
            GraphNodes = []
            edgelines = []
            
            # create containers for the drawing data
            node_drawing_list = []
            edge_drawing_list = []
            data_drawing_list = []
            
            # loop over all the rows of the pattern data
            for i, row in enumerate(PatternData):
                # compute the y-coordinate
                yval = PaddingY * i
                
                # loop over all items in the current row (columns)
                for j, value in enumerate(row):
                    # if the current value is not a placeholder, set the flat node
                    # coordinates and create the node in the layout
                    if value >= 0:
                        # compute point location for flat layout
                        pt = origin + Rhino.Geometry.Vector3d(PaddingX * j, yval, 0)
                        
                        # append point to output list
                        grid[i].append(pt)
                        
                        # set the node coordinates of the flat network
                        FlatDual.node[value]["geo"] = pt
                        FlatDual.node[value]["x"] = pt.X
                        FlatDual.node[value]["y"] = pt.Y
                        FlatDual.node[value]["z"] = pt.Z
                        
                        # create the display geometry
                        if NodeDisplay == 0:
                            graphnode = Rhino.Geometry.Circle(pt, NodeRadius)
                        elif NodeDisplay == 1:
                            recpln = Plane.Clone()
                            recpln.Origin = pt
                            recinterval = Rhino.Geometry.Interval(NodeRadius * -1,
                                                                  NodeRadius)
                            graphnode = Rhino.Geometry.Rectangle3d(recpln,
                                                                   recinterval,
                                                                   recinterval)
                            graphnode = graphnode.ToNurbsCurve()
                        # append geometry to output list
                        GraphNodes.append(graphnode)
                        
                        # get the node data from the dual
                        node_data = FlatDual.node[value]
                        node_color = self.node_color(node_data)
                        node_drawing_list.append((graphnode, node_color))
                        
                        if DrawData:
                            NodeTextPlane = Plane.Clone()
                            NodeTextPlane.Origin = (pt + 
                                Rhino.Geometry.Vector3d(NodeRadius * -0.33,
                                                        NodeRadius * 0.5,
                                                        0))
                            tagTxt = Rhino.Display.Text3d(str(value),
                                                              NodeTextPlane,
                                                              NodeRadius * 0.15)
                            tagTxt.FontFace = "Source Sans Pro"
                            data_drawing_list.append((tagTxt, node_color))
                            
                            nodeLabel = [(k, node_data[k]) for k in node_data
                                         if k != "geo" and
                                            k != "x" and
                                            k != "y" and
                                            k != "z"]
                            nodeLabel = ["{}: {}".format(t[0], t[1])
                                         for t in nodeLabel]
                            nodeLabel.sort()
                            nodeLabel = ["", ""] + nodeLabel
                            nodeLabel = "\n".join(nodeLabel)
                            nodeTxt = Rhino.Display.Text3d(str(nodeLabel),
                                                          NodeTextPlane,
                                                          NodeRadius * 0.06)
                            nodeTxt.FontFace = "Source Sans Pro"
                            data_drawing_list.append((nodeTxt, node_color))
                        
                    else:
                        continue
            
            WeftEdgeLines = []
            WarpEdgeLines = []
            
            # loop over all edges in the dual and create the flat geometry
            # for the layout
            for edge in FlatDual.edges_iter(data=True):
                # get from and to point
                ptA = FlatDual.node[edge[0]]["geo"]
                ptB = FlatDual.node[edge[1]]["geo"]
                # create line
                ln = Rhino.Geometry.Line(ptA, ptB)
                edge[2]["geo"] = ln
                # shorten line according to node radius
                ln = Rhino.Geometry.Line(ln.PointAtLength(NodeRadius),
                                         ln.PointAtLength(ln.Length - NodeRadius))
                # create drawing display
                if not edge[2]["weft"] and not edge[2]["warp"]:
                    edge_drawing_list.append((ln, contourcol))
                    
                    
                    data_drawing_list.append((tagTxt, contourcol))
                elif edge[2]["weft"]:
                    WeftEdgeLines.append(ln)
                    edge_drawing_list.append((ln, weftcol))
                    
                    if DrawData:
                        EdgeTextPlane = Plane.Clone()
                        EdgeTextPlane.Origin = (ln.PointAt(0.5) 
                                                - Rhino.Geometry.Vector3d(
                                                            NodeRadius * 0.4,
                                                            NodeRadius * 0.2,
                                                            0))
                        edgeLabel = [(k, edge[2][k]) for k
                                     in edge[2] if k != "geo"]
                        edgeLabel = ["{}: {}".format(t[0], t[1]) for t
                                     in edgeLabel]
                        edgeLabel.sort()
                        edgeLabel = [str(edge[0]) + "-" +
                                     str(edge[1])] + edgeLabel
                        edgeLabel = "\n".join(edgeLabel)
                        tagTxt = Rhino.Display.Text3d(str(edgeLabel),
                                                      EdgeTextPlane,
                                                      NodeRadius * 0.09)
                        tagTxt.FontFace = "Source Sans Pro"
                        data_drawing_list.append((tagTxt, weftcol))
                    
                elif edge[2]["warp"]:
                    WarpEdgeLines.append(ln)
                    edge_drawing_list.append((ln, warpcol))
                    
                    if DrawData:
                        EdgeTextPlane = Plane.Clone()
                        EdgeTextPlane.Origin = (ln.PointAt(0.5) 
                                                + Rhino.Geometry.Vector3d(
                                                            NodeRadius * 0.1,
                                                            NodeRadius * 0.2,
                                                            0))
                        edgeLabel = [(k, edge[2][k]) for k
                                     in edge[2] if k != "geo"]
                        edgeLabel = ["{}: {}".format(t[0], t[1]) for t
                                     in edgeLabel]
                        edgeLabel.sort()
                        edgeLabel = [str(edge[0]) + "-" +
                                     str(edge[1])] + edgeLabel
                        edgeLabel = "\n".join(edgeLabel)
                        tagTxt = Rhino.Display.Text3d(str(edgeLabel),
                                                      EdgeTextPlane,
                                                      NodeRadius * 0.09)
                        tagTxt.FontFace = "Source Sans Pro"
                        data_drawing_list.append((tagTxt, warpcol))
            
            # set attributes and draw
            self.drawing_nodes = node_drawing_list
            self.drawing_edges = edge_drawing_list
            self.drawing_data = data_drawing_list
            
            TextTags = [TextGoo(t[0]) for t in data_drawing_list]
            
            # return outputs if you have them; here I try it for you:
            return FlatDual, GraphNodes, WeftEdgeLines, WarpEdgeLines, TextTags
        
        else:
            self.drawing_nodes = []
            self.drawing_edges = []
            self.drawing_data = []
# ---------- end vpd ----------
